# Grasshopper definition a01_rfunits.ghx (Grasshopper 1.0.8)

number_slider = Slider(0.1, range=0.1..3)
number_slider_2 = Slider(0, range=-0.5..0.5)
number_slider_3 = Slider(0, range=-0.5..0.5)
# RF Structures
# A01 RF Units
# Task Description: # Assignment 01
# 
# > Goal: Create a parametric Reciprocal Frame Unit (`RFUnit`) class that represents the fundamental building block of reciprocal frame structures. An RF Unit is a 2D representation of the closed circuit of rods in an RF Structure. It's enclosed by a polygonal shape and it has exactly one connection point on each of its edges. The assumption of "exactly one connection point per edge" is fundamental to define a consistent interface to these units. Internally, the units could theoretically be any arbitrarely complex set of segments, however, we will limit it to matching segment count to edge count.
# 
# Your starting point is the `a01_rfunits.ghx` file that contains some components and comments for line-by-line guidance. This line-by-line guidance can be ignored if desired to implement in a different way.
# 
# ### Main Task
# 
# - Create `RFUnit`, `ConnectionPoint` and `RodSegment` classes:
#    - `RFUnit`: needs the following constructor arguments: a polygon shape, start eccentricity, end eccentricity and overlap. It should also define computed attributes / properties (hint: using the `@property` decorator), to return centroid and edges, which are the shape's centroid and shape's lines respectively.
#    - `ConnectionPoint`: needs the following constructor arguments: a point, a parameter and a vector.
#    - `RodSegment`: needs the following constructor arguments: a start and end point. A property to return the line represented by it should also be present.
# - Allow to parametrize the unit based on start and end eccentricity
# - Visualize the unit's segments and edges in Rhino
# - Bonus: allow creation from number of sides + edge length instead of radius
# - Topics: Classes, properties, typing (Python 3), Geometry (Vector arithmetics, Line, Polygon)
# 
# ### Challenge 01
# 
# - Control overlap adjustment precisely by making sure the lines are extended by the configured amount only after the intersection point with the other line.
# - Topics: Intersections, Geometry (Vector arithmetics, Polygon)
# 
# ### Challenge 02
# 
# - Materialize it with `compas_timber` using the logic of assignment 00 but detect the cycles automatically
# - Use two types of connections: TButtJoint and XLapJoint
# - Topics: compas_timber model, beams and connections, wrap-around pairing list
# 
# ## Deliverables
# 
# One zip file [`mustermann_max_A-01.zip`] containing:
# 
# - Grasshopper File (`.ghx`):
#   - File Name: `mustermann_max_A-01.ghx`
#   - Optionally, a python file `a01_rfunits_solution.py` containing the solution if you choose to use VS Code.
# - Screenshots (`.png`):
#   - File Name: `mustermann_max_A-01_xx.png`
#   - Dimensions: 3200x2400 px
#   - View: Parallel, Shaded
# 
# ## Submission
# 
# Upload the assignment via Moodle.
# Main Task
# Challenge 01
# Challenge 02
# A01 RF Units
number_slider_4 = Slider(3, range=3..20)
number_slider_5 = Slider(0, range=0..1)
rf_unit = Python3Script()  # -> segment_lines, shape_edges
# ---------- rf_unit: Python ----------
# r: compas>=2.9, compas_timber>=0.14
# venv: ca-fs25

from compas.geometry import Line
from compas.geometry import Point
from compas.geometry import Polygon
from compas.geometry import Vector
from compas.geometry import intersection_line_line

# 1. Create a class ConnectionPoint with the attributes indicated in the description of the assignment
# [ADD YOUR CODE HERE...]
# class ...

# 2. Create a class RodSegment with:
#    - the attributes indicated in the description of the assignment
#    - a computed attribute (i.e. property) to calculate the resulting compas.geometry.Line
# [ADD YOUR CODE HERE...]
# class ...

# 3. Create a class RFUnit:
# [ADD YOUR CODE HERE...]
# class ...

    # 4. Add your constructor with:
    #    - the attributes indicated in the description of the assignment
    #    - initialize any lists that might be needed as attributes as well
    # [ADD YOUR CODE HERE...]

    # 5. Add properties for centroid and edges that can be derived from the underlying polygon 
    # [ADD YOUR CODE HERE...]

    # 6. Add a method generate_segments() to calculate segments and connection points based on the attributes of the instance
    # [ADD YOUR CODE HERE...]
    # ..
        # 6.1. Initialize all needed lists
        # [ADD YOUR CODE HERE...]

        # 6.2. For each edge
        # [ADD YOUR CODE HERE...]

            # 6.3. Calculate the midpoint and normal vector to the edge
            # [ADD YOUR CODE HERE...]

            # 6.4. Apply the eccentricitiess to move the centroid and edge midpoint to the correct location
            # [ADD YOUR CODE HERE...]

            # 6.5. Calculate the midpoint
            # [ADD YOUR CODE HERE...]

            # 6.6. Create an instance of the RogSegment and append to the correct list
            # [ADD YOUR CODE HERE...]

            # 6.7. Create an instance of ConnectionPoint
            #     - Use the method `edge.closest_point()` to get the parameter that corresponds to that point
            #     - Calculate the unitized vector between start and end
            #     - Append to the correct list
            # [ADD YOUR CODE HERE...]

    # 7. [CHALLENGE 01] Add a method adjust_segments() the overshoot of segments based on the overlap attribute
    # [ADD YOUR CODE HERE...]
    # ..
        # 7.1 Iterate over pairs of segments, eg. (0, 1), (1, 2), (2, 0), making sure that you
        #     wrap around on the last one to pair with the first one. HINT: Use modulo to calculate that!
        # [ADD YOUR CODE HERE...]

        # 7.2. For each pair, find the line/line intersection between the two segments
        #      If they don't intersect, just keep the segment as it is
        # [ADD YOUR CODE HERE...]

        # 7.3. If the intersect, calculate the new segment's start point by overshooting
        #      from the intersection point in the direction of the vector defined by the 
        #      segment's start and the intersection point
        # [ADD YOUR CODE HERE...]


        # 7.4. Finally, reassign/update the segments' list of the unit with all the adjusted segments
        # [ADD YOUR CODE HERE...]


# Inside the follwoing block, you can add the code that is always executed when the component runs.
# It's the part of the code that takes the input params of the component, and does things with them.
if __name__ == "__main__":
    # 8.1 Create a polygon instance
    # [ADD YOUR CODE HERE...]

    # 8.2 Create the RFUnit instance
    # [ADD YOUR CODE HERE...]

    # 8.3 Output the edges and segment lines. You can visualize with the COMPAS Draw component right after
    # [ADD YOUR CODE HERE...]
    
    
    pass
# ---------- end rf_unit ----------

unit_z = UnitZ(Factor=1)
ct_model = Python3Script(lines=rf_unit.segment_lines, width=Slider(0.06, range=0.01..1.1), height=Slider(0.08, range=0.01..1.1), z_vector=unit_z)  # -> geo; inputs lines: list, z_vector: Vector3d
# ---------- ct_model: Python ----------
# r: compas>=2.9, compas_timber>=0.14
# venv: ca-fs25

# [CHALLENGE 02]
from compas_rhino.conversions import vector_to_compas
from compas_timber.connections import XLapJoint, TButtJoint
from compas_timber.elements import Beam
from compas_timber.model import TimberModel


# 1. Create a TimberModel from compas_timber
# [ADD YOUR CODE HERE...]

# 2. For each line, create a beam (Beam.from_centerline) and add to model
# [ADD YOUR CODE HERE...]

# 3. Iterate in pairs of beams wrapping around to create joints between each pair
#    - Use XLapJoint or TButtJoint
#    - Bonus: allow to select which joint type with a drop down in GH
# [ADD YOUR CODE HERE...]

# 4. Process the joinery of the model
# [ADD YOUR CODE HERE...]

# 5. Output the geometry of each of the beams to be visualized with a COMPAS DRAW component
# [ADD YOUR CODE HERE...]
# ---------- end ct_model ----------

compas_draw = COMPASDraw(cg=rf_unit.segment_lines)  # -> rg
#   port cg: The COMPAS geometry or datastructure to be drawn.
#   port rg: The Rhino geometry object.
# ---------- compas_draw: Python ----------
# r: compas>=2.8.1
"""
Draws COMPAS geometry in Grasshopper.
"""

from typing import Any

import Grasshopper

from compas.scene import SceneObject


class CompasToRhinoGeometry(Grasshopper.Kernel.GH_ScriptInstance):
    def RunScript(self, cg):
        if not cg:
            return None

        return SceneObject(item=cg).draw()
# ---------- end compas_draw ----------
compas_draw_2 = COMPASDraw(cg=rf_unit.shape_edges)  # -> rg; same code as compas_draw

compas_draw_3 = COMPASDraw(cg=ct_model)  # -> rg; same code as compas_draw

# ---- group: 2. Set file name
panel = Panel("mustermann_max")
panel_2 = Panel("A01_")

# ---- group: 3. Click button to save image
button = Button()

# ---- group: 1. Select target directory
# Submission Image
path = FilePath()

# ----
screenshot_tool = GhPythonScript(
    path=path,
    name=panel,
    assignment_nr=panel_2,
    width="3200",
    height="2400",
    display_grid="False",
    display_grid_axes="False",
    save=button)  # -> out; inputs width: Int32, height: Int32, display_grid: Boolean, display_grid_axes: Boolean
# ---------- screenshot_tool: Python ----------
import Rhino.Display as rd
import scriptcontext as sc
import System
import os

file_name = name + "_" + assignment_nr

def get_next_index(path):
    index = 1
    while os.path.exists(path + file_name + str(index) + ".png"):
        index += 1
    return index

def ViewCaptureToFile(path):
    view = sc.doc.Views.ActiveView
    if view:
        view_capture = rd.ViewCapture()
        view_capture.TransparentBackground = False
        view_capture.Width = view.ActiveViewport.Size.Width
        view_capture.Height = view.ActiveViewport.Size.Width
        view_capture.ScaleScreenItems = False
        view_capture.DrawAxes = True
        view_capture.DrawGrid = display_grid
        view_capture.DrawGridAxes = display_grid_axes
        size = System.Drawing.Size(view_capture.Width, view_capture.Height)
        size = System.Drawing.Size(width, height)
        
        settings = rd.ViewCaptureSettings(view, size, 72) # view, size, dpi
        settings.RasterMode = True
        settings.DrawGrid = False
        settings.DrawAxis = False
        settings.DrawWallpaper = False
        index = get_next_index(path)
            
        filename = file_name + str(index)
        filename_with_extension = filename + ".png"
        bitmap = rd.ViewCapture.CaptureToBitmap(settings)
        fullpath = path + filename_with_extension
        bitmap.Save(fullpath)
        
        return filename_with_extension
        
        
if path is None:
    ghenv.Component.Message = "Please select a target directory first"
else:
    if save:
        path = ViewCaptureToFile(path)
        ghenv.Component.Message = "Saved image to " + path
# ---------- end screenshot_tool ----------
