# Grasshopper definition a02_tessellation_solution.ghx (Grasshopper 1.0.8)

# RF Structures
# A02 RF Tessellation
task_description = Panel("""# Assignment 02

> Goal: Create a Reciprocal Frame Tessellation (`RFTessellation`) class that allows to arrange/combine multiple units (`RFUnit` instances) in a congruent tiling layout following one or more grammar rules (`RFGrammarRule` instances).

Your starting point is the [`a02_rftessellation.ghx`](a02_rftessellation.ghx) file that contains some components and comments for line-by-line guidance. This line-by-line guidance can be ignored if desired to implement in a different way.


### Main Task

- Create an `RFTessellation` class that allows to apply grammar rules to create a 2D tessellation.
- The goal is to implement a method `apply_single_rule_cycle` that applies a single cycle of  rules around a specific vertex.
- The application of rules follows a specific sequence called **Schläfli Notation**, this notation dictates which unit is selected at which stage. Example: In a `6.3.6.3` sequence, the first unit is a triangle, so Unit 1 of the rule will be a triangle, and Unit 2 will be a hexagon. To apply the rule one more time, the newly created hexagon becomes the Unit 1 of the next rule, and the Unit 2 will now be a triangle.
- It is important to select the correct edges for each successive rule application.
- The storage of units created by the rule application, as well as the internal structure of the tessellation will not be a list of `RFUnit` instances, instead, we will use a `compas.datastructures.Graph` that will track not only the units created, but also their connections (as edges of the graph).
- Implement the method to support only SINGLE RULE and a SINGLE CYCLE. That means that the rule will have to be reversed every time we move to the next application. This means that the possible vertex configuration supported are limited to those that have only 2 types of units and can be sequenced with the simple reversal/alternation of the rule.

- Details:
  - To ease tracking, add an attribute `key` to the `RFUnit` class created before.
  - Create a `Graph` on initialization. Each time we add a unit, we will create a graph node with the unit instance as its data.
  - Implement a `@property` called `units` to access the units stored in the edges of the graph.
  - Implement the `apply_single_rule_cycle` method that iteratively:
    - Gets the next available edge of unit 1
    - Applies the rule to create a new unit.
    - Add the new unit to the graph following these steps:
      - Update the `key` of the newly added unit to the one that graph returns when adding a new node.
      - Add a node attribute `connected_shape_edges` as a list containing the shape edge that was connected. This will always be 0 because we start connecting on the 0 edge of the new unit.
      - Update the `connected_shape_edges` node attribute of the unit 1, to reference the edge that was connected.
      - Add a graph edge between unit 1 and the new unit.
    - Check if we completed the cycle and exit/return if so
    - Prepare the next rule. For convenience, you might want to write a method `reversed` on the `RFGrammarRule` class that creates a reversed rule.
- Topics: Classes, properties, graphs (`compas.datastructures.Graph`), Geometry (Vector arithmetics, Line, Polygon)

### Challenge 01

- Implement a mechanism to detect when a cycle has been completed and the application of rules loops back into an existing unit.
- Detecting if a new unit is looping back into ANY other unit is complex, we need to follow a few steps:
  - For all the free edges of the newly created unit
  - Compare each connection point to the closest connection point of any other existing unit. To do this, collect all other connection points and sort them first.
  - If the closest (first) connection point is at a `distance=0` of the connection point of the newly created unit, it means there's a cycle: add the edge and corresponding node attributes updates (`connected_shape_edges`) to keep track of it all.
- Topics: Graphs.

### Challenge 02

- Create a second, more advanced method to apply rules in the tessellation, and this time allow more than one rule to be define. This extend the possible vertex configurations supported to a more complex set, allowing 3 or more units, and non-alternating sequences.

- Details:
  - Create a vertex pair iterator based on the schläfli notation (vertex configuration), that will return vertices in pairs (infinitely, using the generator/iterator pattern of Python).
  - Create a dictionary of rules based on their vertex pair, so that we can look them up quickly during application.
  - During application, select the next vertex pair from the iterator, locate a rule that matches that, and prepare it for application.
- Topics: generator/iterators.""")

# ----
# A02 RF Tessellation
boolean_toggle = BooleanToggle(True)
reload = Script(enabled=boolean_toggle)
# ---------- reload: Python ----------
from compas_rhino.devtools import DevTools
if enabled:
    DevTools.enable_reloader()
else:
    DevTools.disable_reloader()
# ---------- end reload ----------

rf_unit = Python3Script(
    sides=Slider(3, range=3..20),
    radius=Slider(0.1, range=0.1..3),
    start_eccentricity=Slider(0, range=-0.5..0.5),
    end_eccentricity=Slider(0, range=-0.5..0.5))  # -> rfunit, segment_lines, shape_edges; inputs sides: Int32
# ---------- rf_unit: Python ----------
# r: compas>=2.9, compas_timber>=0.14
# venv: ca-fs25

from compas_rhino import DevTools
DevTools.ensure_path()

from compas.geometry import Polygon
from a02_tessellation_solution import RFUnit

shape = Polygon.from_sides_and_radius_xy(sides, radius)

# 8.2 Create the RFUnit instance
rfunit = RFUnit(shape, start_eccentricity, end_eccentricity, 0)
rfunit.generate_segments()

# 8.3 Output the edges and segment lines. You can visualize with the COMPAS Draw component right after
shape_edges = rfunit.edges
segment_lines = [segment.line for segment in rfunit.segments]
# ---------- end rf_unit ----------
rf_unit_2 = Python3Script(
    sides=Slider(6, range=3..20),
    radius=Slider(0.171, range=0.1..3),
    start_eccentricity=Slider(-0.23, range=-0.5..0.5),
    end_eccentricity=Slider(0, range=-0.5..0.5))  # -> rfunit, segment_lines, shape_edges; inputs sides: Int32; same code as rf_unit
compas_draw = COMPASDraw(cg=rf_unit.segment_lines)  # -> rg
#   port cg: The COMPAS geometry or datastructure to be drawn.
#   port rg: The Rhino geometry object.
# ---------- compas_draw: Python ----------
# r: compas>=2.8.1
"""
Draws COMPAS geometry in Grasshopper.
"""

from typing import Any

import Grasshopper

from compas.scene import SceneObject


class CompasToRhinoGeometry(Grasshopper.Kernel.GH_ScriptInstance):
    def RunScript(self, cg):
        if not cg:
            return None

        return SceneObject(item=cg).draw()
# ---------- end compas_draw ----------
compas_draw_2 = COMPASDraw(cg=rf_unit.shape_edges)  # -> rg; same code as compas_draw
compas_draw_3 = COMPASDraw(cg=rf_unit_2.segment_lines)  # -> rg; same code as compas_draw
compas_draw_4 = COMPASDraw(cg=rf_unit_2.shape_edges)  # -> rg; same code as compas_draw

# ----
# Only if tackling challenge 02
number_slider = Slider(3, range=3..20)
rf_unit_3 = Python3Script(
    sides=number_slider,
    radius=Slider(0.15, range=0.1..3),
    start_eccentricity=Slider(0, range=-0.5..0.5),
    end_eccentricity=Slider(0, range=-0.5..0.5))  # -> rfunit, segment_lines, shape_edges; inputs sides: Int32; same code as rf_unit
rf_unit_4 = Python3Script(
    sides=Slider(3, range=3..20),
    radius=Slider(0.15, range=0.1..3),
    start_eccentricity=Slider(0.2, range=-0.5..0.5),
    end_eccentricity=Slider(0, range=-0.5..0.5))  # -> rfunit, segment_lines, shape_edges; inputs sides: Int32; same code as rf_unit
rf_unit_5 = Python3Script(
    sides=Slider(4, range=3..20),
    radius=Slider(0.184, range=0.1..3),
    start_eccentricity=Slider(0.2, range=-0.5..0.5),
    end_eccentricity=Slider(0, range=-0.5..0.5))  # -> rfunit, segment_lines, shape_edges; inputs sides: Int32; same code as rf_unit
compas_draw_5 = COMPASDraw(cg=rf_unit_3.segment_lines)  # -> rg; same code as compas_draw
compas_draw_6 = COMPASDraw(cg=rf_unit_3.shape_edges)  # -> rg; same code as compas_draw
compas_draw_7 = COMPASDraw(cg=rf_unit_4.segment_lines)  # -> rg; same code as compas_draw
compas_draw_8 = COMPASDraw(cg=rf_unit_4.shape_edges)  # -> rg; same code as compas_draw
compas_draw_9 = COMPASDraw(cg=rf_unit_5.segment_lines)  # -> rg; same code as compas_draw
compas_draw_10 = COMPASDraw(cg=rf_unit_5.shape_edges)  # -> rg; same code as compas_draw

script = Script(
    unit1=rf_unit.rfunit,
    unit2=rf_unit_2.rfunit,
    edge1=Slider(0, range=0..6),
    edge2=Slider(0, range=0..6),
    mirror=Toggle(False))  # -> rule, geo; inputs edge1: Int32, edge2: Int32
# ---------- script: Python ----------
# r: compas>=2.9, compas_timber>=0.14
# venv: ca-fs25

from compas_rhino import DevTools
DevTools.ensure_path()

from a02_tessellation_solution import RFGrammarRule


rule = RFGrammarRule(unit1, unit2, edge1, edge2, mirror)
new_unit = rule.apply_rule(edge1, edge2, mirror)

geo = []
shape_edges = unit1.edges + new_unit.edges
segment_lines = [segment.line for segment in unit1.segments]
segment_lines += [segment.line for segment in new_unit.segments]
geo = shape_edges + segment_lines
# ---------- end script ----------
compas_draw_11 = COMPASDraw(cg=script.geo)  # -> rg; same code as compas_draw

script_2 = Script(
    unit1=rf_unit_3.rfunit,
    unit2=rf_unit_4.rfunit,
    edge1=Slider(0, range=0..6),
    edge2=Slider(0, range=0..6),
    mirror=Toggle(True))  # -> rule, geo; inputs edge1: Int32, edge2: Int32; same code as script
script_3 = Script(
    unit1=rf_unit_4.rfunit,
    unit2=rf_unit_5.rfunit,
    edge1=Slider(0, range=0..6),
    edge2=Slider(0, range=0..6),
    mirror=Toggle(True))  # -> rule, geo; inputs edge1: Int32, edge2: Int32; same code as script
compas_draw_12 = COMPASDraw(cg=script_2.geo)  # -> rg; same code as compas_draw
compas_draw_13 = COMPASDraw(cg=script_3.geo)  # -> rg; same code as compas_draw

# ---- group: 2. Set file name
panel = Panel("mustermann_max")
panel_2 = Panel("A02_")

# ---- group: 3. Click button to save image
button = Button()

# ---- group: 1. Select target directory
# Submission Image
path = FilePath()

# ----
screenshot_tool = GhPythonScript(
    path=path,
    name=panel,
    assignment_nr=panel_2,
    width="3200",
    height="2400",
    display_grid="False",
    display_grid_axes="False",
    save=button)  # -> out; inputs width: Int32, height: Int32, display_grid: Boolean, display_grid_axes: Boolean
# ---------- screenshot_tool: Python ----------
import Rhino.Display as rd
import scriptcontext as sc
import System
import os

file_name = name + "_" + assignment_nr

def get_next_index(path):
    index = 1
    while os.path.exists(path + file_name + str(index) + ".png"):
        index += 1
    return index

def ViewCaptureToFile(path):
    view = sc.doc.Views.ActiveView
    if view:
        view_capture = rd.ViewCapture()
        view_capture.TransparentBackground = False
        view_capture.Width = view.ActiveViewport.Size.Width
        view_capture.Height = view.ActiveViewport.Size.Width
        view_capture.ScaleScreenItems = False
        view_capture.DrawAxes = True
        view_capture.DrawGrid = display_grid
        view_capture.DrawGridAxes = display_grid_axes
        size = System.Drawing.Size(view_capture.Width, view_capture.Height)
        size = System.Drawing.Size(width, height)
        
        settings = rd.ViewCaptureSettings(view, size, 72) # view, size, dpi
        settings.RasterMode = True
        settings.DrawGrid = False
        settings.DrawAxis = False
        settings.DrawWallpaper = False
        index = get_next_index(path)
            
        filename = file_name + str(index)
        filename_with_extension = filename + ".png"
        bitmap = rd.ViewCapture.CaptureToBitmap(settings)
        fullpath = path + filename_with_extension
        bitmap.Save(fullpath)
        
        return filename_with_extension
        
        
if path is None:
    ghenv.Component.Message = "Please select a target directory first"
else:
    if save:
        path = ViewCaptureToFile(path)
        ghenv.Component.Message = "Saved image to " + path
# ---------- end screenshot_tool ----------

# ---- group: TESSELLATION
value_list = ValueList({"(3, 3, 3, 3, 3, 3)", "(4, 4, 4, 4)", "(3, 6, 3, 6)", "(6, 6, 6)", "(3, 3, 4, 3, 4)", "(4, 8, 8)", "(3, 3, 3, 3, 6)"}, selected="(3, 3, 4, 3, 4)")
script_4 = Script(rules=[script_2.rule, script_3.rule], vertex_config=value_list)  # -> geo, location, text, graph; inputs rules: list
# ---------- script_4: Python ----------
# r: compas>=2.9, compas_timber>=0.14
# venv: ca-fs25

from compas_rhino import DevTools
DevTools.ensure_path()

from compas_rhino.conversions import line_to_rhino_curve, point_to_rhino
from a02_tessellation_solution import RFTessellation

vertex_config = eval(vertex_config)

tess = RFTessellation(vertex_configuration=vertex_config)
tess.apply_rules_cycle(rules)

# For each unit in the tessellation, assign the xyz values of the node attribute to the unit's centroid
graph = tess.graph
geo = []
edges = []
segments = []

text = []
location = []

for unit in tess.units:
    text.append(f"Unit={unit.key}")
    location.append(point_to_rhino(unit.centroid))
    tess.graph.node_attributes(unit.key, "xyz", list(unit.centroid))
    edges.extend(unit.edges)
    segments.extend(unit.segments)

geo.extend(map(line_to_rhino_curve, edges))
geo.extend([line_to_rhino_curve(segment.line)  for segment in segments])
# ---------- end script_4 ----------
compas_draw_14 = COMPASDraw(cg=script_4.graph)  # -> rg; same code as compas_draw
text_tag_3d = TextTag3D(Location=script_4.location, Text=script_4.text, Size=Slider(0.039, range=0.001..1), Justification=7)

value_list_2 = ValueList({"(3, 3, 3, 3, 3, 3)", "(4, 4, 4, 4)", "(3, 6, 3, 6)", "(6, 6, 6)", "(3, 3, 4, 3, 4)", "(4, 8, 8)", "(3, 3, 3, 3, 6)"}, selected="(3, 6, 3, 6)")
script_5 = Script(rule=script.rule, vertex_config=value_list_2)  # -> geo, location, text, graph
# ---------- script_5: Python ----------
# r: compas>=2.9, compas_timber>=0.14
# venv: ca-fs25

from compas_rhino import DevTools
DevTools.ensure_path()

from compas_rhino.conversions import line_to_rhino_curve, point_to_rhino
from a02_tessellation_solution import RFTessellation

vertex_config = eval(vertex_config)

if set(vertex_config) != set([len(rule.unit1.edges), len(rule.unit2.edges)]):
    raise Exception("Mismatch between vertex config and input units!")

tess = RFTessellation(vertex_configuration=vertex_config)
tess.apply_single_rule_cycle(rule)

# For each unit in the tessellation, assign the xyz values of the node attribute to the unit's centroid
graph = tess.graph
geo = []
edges = []
segments = []

text = []
location = []

for unit in tess.units:
    text.append(f"Unit={unit.key}")
    location.append(point_to_rhino(unit.centroid))
    tess.graph.node_attributes(unit.key, "xyz", list(unit.centroid))
    edges.extend(unit.edges)
    segments.extend(unit.segments)

geo.extend(map(line_to_rhino_curve, edges))
geo.extend([line_to_rhino_curve(segment.line)  for segment in segments])
# ---------- end script_5 ----------
compas_draw_15 = COMPASDraw(cg=script_5.graph)  # -> rg; same code as compas_draw
text_tag_3d_2 = TextTag3D(Location=script_5.location, Text=script_5.text, Size=Slider(0.039, range=0.001..1), Justification=7)
