# Grasshopper definition a03_lift_solution.ghx (Grasshopper 1.0.8)

# ----
# RF Units
number_slider = Slider(3, range=3..20)
rf_unit = Python3Script(
    sides=Slider(8, range=3..20),
    edge_length=Slider(0.65, range=0.1..3),
    start_eccentricity=Slider(0.344, range=-0.5..0.5),
    end_eccentricity=Slider(0, range=-0.5..0.5),
    overlap=Slider(0.056, range=0..0.5))  # -> rfunit, segment_lines, shape_edges; inputs sides: Int32
# ---------- rf_unit: Python ----------
# r: compas>=2.9, compas_timber>=0.14
# venv: ca-fs25

from compas_rhino import DevTools
DevTools.ensure_path()

import math

from compas.geometry import Polygon
from a03_lift_solution import RFUnit

radius = edge_length / (2 * math.sin(math.pi / sides))
shape = Polygon.from_sides_and_radius_xy(sides, radius)

# 8.2 Create the RFUnit instance
rfunit = RFUnit(shape, start_eccentricity, end_eccentricity, overlap)
rfunit.generate_segments()
rfunit.adjust_segments()

# 8.3 Output the edges and segment lines. You can visualize with the COMPAS Draw component right after
shape_edges = rfunit.edges
segment_lines = [segment.line for segment in rfunit.segments]
# ---------- end rf_unit ----------
rf_unit_2 = Python3Script(
    sides=number_slider,
    edge_length=Slider(0.65, range=0.1..3),
    start_eccentricity=Slider(0.096, range=-0.5..0.5),
    end_eccentricity=Slider(0.11, range=-0.5..0.5),
    overlap=Slider(0.26, range=0..0.5))  # -> rfunit, segment_lines, shape_edges; inputs sides: Int32; same code as rf_unit
rf_unit_3 = Python3Script(
    sides=Slider(4, range=3..20),
    edge_length=Slider(0.65, range=0.1..3),
    start_eccentricity=Slider(0.218, range=-0.5..0.5),
    end_eccentricity=Slider(0.11, range=-0.5..0.5),
    overlap=Slider(0.071, range=0..0.5))  # -> rfunit, segment_lines, shape_edges; inputs sides: Int32; same code as rf_unit
rf_unit_4 = Python3Script(
    sides=Slider(6, range=3..20),
    edge_length=Slider(0.7, range=0.1..3),
    start_eccentricity=Slider(0.34, range=-0.5..0.5),
    end_eccentricity=Slider(0, range=-0.5..0.5),
    overlap=Slider(0.11, range=0..0.5))  # -> rfunit, segment_lines, shape_edges; inputs sides: Int32; same code as rf_unit
compas_draw = COMPASDraw(cg=rf_unit_2.segment_lines)  # -> rg
#   port cg: The COMPAS geometry or datastructure to be drawn.
#   port rg: The Rhino geometry object.
# ---------- compas_draw: Python ----------
# r: compas>=2.8.1
"""
Draws COMPAS geometry in Grasshopper.
"""

from typing import Any

import Grasshopper

from compas.scene import SceneObject


class CompasToRhinoGeometry(Grasshopper.Kernel.GH_ScriptInstance):
    def RunScript(self, cg):
        if not cg:
            return None

        return SceneObject(item=cg).draw()
# ---------- end compas_draw ----------
compas_draw_2 = COMPASDraw(cg=rf_unit_2.shape_edges)  # -> rg; same code as compas_draw
compas_draw_3 = COMPASDraw(cg=rf_unit_3.segment_lines)  # -> rg; same code as compas_draw
compas_draw_4 = COMPASDraw(cg=rf_unit_3.shape_edges)  # -> rg; same code as compas_draw
compas_draw_5 = COMPASDraw(cg=rf_unit_4.segment_lines)  # -> rg; same code as compas_draw
compas_draw_6 = COMPASDraw(cg=rf_unit_4.shape_edges)  # -> rg; same code as compas_draw
compas_draw_7 = COMPASDraw(cg=rf_unit.segment_lines)  # -> rg; same code as compas_draw
compas_draw_8 = COMPASDraw(cg=rf_unit.shape_edges)  # -> rg; same code as compas_draw

# ----
# RF Structures
# A03 Lift structure to 3d
# Main task: # Assignment 03
# 
# > Goal: Map the 2D tessellation -including all of its parts (units, segments, rods, beams)- to a 3D surface that will eventually become the final design.
# 
# Your starting point is the [`a03_lift_solution.ghx`](a03_lift_solution.ghx) file and the [`a03_lift_solution.py`](a03_lift_solution.py) file. The Grasshopper file contains some components but the large majority of the assignment code should be written in the Python file, which also contains comments for line-by-line guidance. This line-by-line guidance can be ignored if desired to implement in a different way.
# Both files contain the markers `[..ADD YOUR CODE HERE..]` to indicate where you should add your code to complete the assignment.
# 
# ### Main Task
# 
# - Add methods to the `RFTessellation` class to map the 2D tessellation to a 3D surface.
# - The method should accept two arguments: a source surface and a target surface. The source surface is expected to be planar, the target surface can be anything.
# - You will rely on the fact that the class now has a `.tessellate()` method that expands the single-cycle tessellation so the tessellation cover bigger areas of the plane.
# - You will apply a UV mapping technique to relate the UV space of the source surface (which overlaps with the 2D tessellation) with the UV space of the target surface.
# - Topics: UV mapping
# A03 Lift structure to 3d
code_reloading = BooleanToggle(True)
# Challenge 01: ### Challenge 01
# 
# - Write an algorithm to determine how many stock beams (each has a length of 5m) are required to build the structure. Minimize the waste by packing as many beams as possible in each stock beam, this also determines how each stock beam will be cut.
# - Once you have determined how to cut the stock beams into your structure's beams, you can now visualize the beams, as well as, the stock beams, laying them out on a surface.
# - Bonus: assume a gap/buffer between each beam to ensure they can be cut correctly.
reload = Script(enabled=code_reloading)
# ---------- reload: Python ----------
# r: compas>=2.9, compas_timber>=0.14
# venv: ca-fs25

from compas_rhino.devtools import DevTools
if enabled:
    DevTools.enable_reloader()
else:
    DevTools.disable_reloader()
# ---------- end reload ----------

# ---- group: 3.3
# RF Grammar Rules
number_slider_2 = Slider(0, range=0..6)
rule = Script(unit1=rf_unit_2.rfunit, edge1=number_slider_2, edge2=Slider(0, range=0..6), mirror=Toggle(True))  # -> rule, geo; inputs edge1: Int32, edge2: Int32
# ---------- rule: Python ----------
# r: compas>=2.9, compas_timber>=0.14
# venv: ca-fs25

from compas_rhino import DevTools
DevTools.ensure_path()

from a03_lift_solution import RFGrammarRule


rule = RFGrammarRule(unit1, unit2, edge1, edge2, mirror)
new_unit = rule.apply_rule(edge1, edge2, mirror)

geo = []
shape_edges = unit1.edges + new_unit.edges
segment_lines = [segment.line for segment in unit1.segments]
segment_lines += [segment.line for segment in new_unit.segments]
geo = shape_edges + segment_lines
# ---------- end rule ----------
compas_draw_9 = COMPASDraw(cg=rule.geo)  # -> rg; same code as compas_draw

# ---- group: 3.6
rule_2 = Script(
    unit1=rf_unit_2.rfunit,
    unit2=rf_unit_4.rfunit,
    edge1=Slider(0, range=0..6),
    edge2=Slider(0, range=0..6),
    mirror=Toggle(False))  # -> rule, geo; inputs edge1: Int32, edge2: Int32; same code as rule
compas_draw_10 = COMPASDraw(cg=rule_2.geo)  # -> rg; same code as compas_draw

# ---- group: 4.4
rule_3 = Script(unit1=rf_unit_3.rfunit, edge1=Slider(0, range=0..6), edge2=Slider(0, range=0..6), mirror=Toggle(True))  # -> rule, geo; inputs edge1: Int32, edge2: Int32; same code as rule
compas_draw_11 = COMPASDraw(cg=rule_3.geo)  # -> rg; same code as compas_draw

# ---- group: 4.6
rule_4 = Script(
    unit1=rf_unit_3.rfunit,
    unit2=rf_unit_4.rfunit,
    edge1=Slider(0, range=0..6),
    edge2=Slider(0, range=0..6),
    mirror=Toggle(True))  # -> rule, geo; inputs edge1: Int32, edge2: Int32; same code as rule
compas_draw_12 = COMPASDraw(cg=rule_4.geo)  # -> rg; same code as compas_draw

# ---- group: 6.6
rule_5 = Script(unit1=rf_unit_4.rfunit, edge1=Slider(0, range=0..6), edge2=Slider(0, range=0..6), mirror=Toggle(True))  # -> rule, geo; inputs edge1: Int32, edge2: Int32; same code as rule
compas_draw_13 = COMPASDraw(cg=rule_5.geo)  # -> rg; same code as compas_draw

# ---- group: 4.8
rule_6 = Script(
    unit1=rf_unit_3.rfunit,
    unit2=rf_unit.rfunit,
    edge1=Slider(0, range=0..6),
    edge2=Slider(0, range=0..6),
    mirror=Toggle(True))  # -> rule, geo; inputs edge1: Int32, edge2: Int32; same code as rule
compas_draw_14 = COMPASDraw(cg=rule_6.geo)  # -> rg; same code as compas_draw

# ---- group: 3.4
rule_7 = Script(
    unit1=rf_unit_2.rfunit,
    unit2=rf_unit_3.rfunit,
    edge1=Slider(0, range=0..6),
    edge2=Slider(0, range=0..6),
    mirror=Toggle(True))  # -> rule, geo; inputs edge1: Int32, edge2: Int32; same code as rule
compas_draw_15 = COMPASDraw(cg=rule_7.geo)  # -> rg; same code as compas_draw

# ---- group: 6.8
rule_8 = Script(
    unit1=rf_unit_3.rfunit,
    unit2=rf_unit.rfunit,
    edge1=Slider(0, range=0..6),
    edge2=Slider(0, range=0..6),
    mirror=Toggle(True))  # -> rule, geo; inputs edge1: Int32, edge2: Int32; same code as rule
compas_draw_16 = COMPASDraw(cg=rule_8.geo)  # -> rg; same code as compas_draw

# ----
merge = Merge(
    Data1=rule.rule,
    Data2=rule_7.rule,
    Data3=rule_2.rule,
    Data4=rule_3.rule,
    Data5=rule_4.rule,
    Data6=rule_5.rule,
    Data7=rule_6.rule,
    Data8=rule_8.rule)

# ---- group: Single Cycle
value_list = ValueList({"(3, 3, 3, 3, 3, 3)", "(4, 4, 4, 4)", "(3, 6, 3, 6)", "(6, 6, 6)"}, selected="(3, 6, 3, 6)")
# RF Tessellation
data = Data(rule_2.rule)
tessellate_single_cycle = Script(rules=data, vertex_config=value_list, show_text=Toggle(False))  # -> tessellation, geo; inputs rules: list
# ---------- tessellate_single_cycle: Python ----------
# r: compas>=2.9, compas_timber>=0.14
# venv: ca-fs25

from compas_rhino import DevTools
DevTools.ensure_path()

from compas_rhino.conversions import line_to_rhino_curve, point_to_rhino
from a03_lift_solution import RFTessellation

import random
import Rhino.Geometry as rg

vertex_config = eval(vertex_config)

tessellation = RFTessellation(vertex_configuration=vertex_config)
tessellation.apply_rules_cycle(rules)

geo = []

for unit in tessellation.units:
    geo.extend(map(line_to_rhino_curve, unit.edges))
    geo.extend([line_to_rhino_curve(segment.line)  for segment in unit.segments])

    if show_text:
        dot = rg.TextDot(f"Unit={unit.key}", point_to_rhino(unit.centroid))
        geo.append(dot)

        for e, cp in enumerate(unit.connection_points):
            dot = rg.TextDot(f"E={unit.key}/{e}", point_to_rhino(cp.point - cp.vector/100.))
            geo.append(dot)
# ---------- end tessellate_single_cycle ----------

# ---- group: Iterative Tessellation
value_list_2 = ValueList({"(3, 3, 3, 3, 3, 3)", "(4, 4, 4, 4)", "(3, 6, 3, 6)", "(6, 6, 6)"}, selected="(6, 6, 6)")
data_2 = Data(merge)
tessellate_iteratively = Script(rules=data_2, vertex_config=value_list_2, max_iterations=Slider(14, range=1..200), show_text=Toggle(False))  # -> tessellation, geo, graph; inputs rules: list, max_iterations: Int32
# ---------- tessellate_iteratively: Python ----------
# r: compas>=2.9, compas_timber>=0.14
# venv: ca-fs25

from compas_rhino import DevTools
DevTools.ensure_path()

from compas_rhino.conversions import line_to_rhino_curve, point_to_rhino
from a03_lift_solution import RFTessellation

import random
import Rhino.Geometry as rg

vertex_config = eval(vertex_config)

tessellation = RFTessellation(vertex_configuration=vertex_config)
tessellation.tessellate(rules, max_iterations=max_iterations)

graph = tessellation.graph

geo = []

for unit in tessellation.units:
    geo.extend(map(line_to_rhino_curve, unit.edges))
    geo.extend([line_to_rhino_curve(segment.line)  for segment in unit.segments])

    if show_text:
        dot = rg.TextDot(f"Unit={unit.key}", point_to_rhino(unit.centroid))
        geo.append(dot)

    # for e, cp in enumerate(unit.connection_points):
    #     dot = rg.TextDot(f"E={unit.key}/{e}", point_to_rhino(cp.point - cp.vector/100.))
    #     geo.append(dot)
# ---------- end tessellate_iteratively ----------
compas_draw_17 = COMPASDraw(cg=tessellate_iteratively.graph)  # -> rg; same code as compas_draw

# ---- group: 2. Set file name
# Challenge 02: ### Challenge 02
# 
# - Add the possiblity of using an attractor point or curve to control local parameters of the tessellation.
# - For example, alter the start eccentricity of units based on the distance between their centroids and the attractor point/curve.
# - Bonus: detect units on the boundary and apply a local effect on them (e.g. set eccentricity to zero).
# - Topics: attractors
panel = Panel("mustermann_max")
panel_2 = Panel("A03_")

# ---- group: 3. Click button to save image
button = Button()

# ---- group: 1. Select target directory
# Submission Image
path = FilePath()

# ----
screenshot_tool = GhPythonScript(
    path=path,
    name=panel,
    assignment_nr=panel_2,
    width="3200",
    height="2400",
    display_grid="False",
    display_grid_axes="False",
    save=button)  # -> out; inputs width: Int32, height: Int32, display_grid: Boolean, display_grid_axes: Boolean
# ---------- screenshot_tool: Python ----------
import Rhino.Display as rd
import scriptcontext as sc
import System
import os

file_name = name + "_" + assignment_nr

def get_next_index(path):
    index = 1
    while os.path.exists(path + file_name + str(index) + ".png"):
        index += 1
    return index

def ViewCaptureToFile(path):
    view = sc.doc.Views.ActiveView
    if view:
        view_capture = rd.ViewCapture()
        view_capture.TransparentBackground = False
        view_capture.Width = view.ActiveViewport.Size.Width
        view_capture.Height = view.ActiveViewport.Size.Width
        view_capture.ScaleScreenItems = False
        view_capture.DrawAxes = True
        view_capture.DrawGrid = display_grid
        view_capture.DrawGridAxes = display_grid_axes
        size = System.Drawing.Size(view_capture.Width, view_capture.Height)
        size = System.Drawing.Size(width, height)
        
        settings = rd.ViewCaptureSettings(view, size, 72) # view, size, dpi
        settings.RasterMode = True
        settings.DrawGrid = False
        settings.DrawAxis = False
        settings.DrawWallpaper = False
        index = get_next_index(path)
            
        filename = file_name + str(index)
        filename_with_extension = filename + ".png"
        bitmap = rd.ViewCapture.CaptureToBitmap(settings)
        fullpath = path + filename_with_extension
        bitmap.Save(fullpath)
        
        return filename_with_extension
        
        
if path is None:
    ghenv.Component.Message = "Please select a target directory first"
else:
    if save:
        path = ViewCaptureToFile(path)
        ghenv.Component.Message = "Saved image to " + path
# ---------- end screenshot_tool ----------

list = ValueList({"Single Cycle": 0, "Iterative": 1}, selected="Iterative")
filter = StreamFilter(Gate=list, Stream0=tessellate_single_cycle.tessellation, Stream1=tessellate_iteratively.tessellation)

# ----
# Localized attractor effects
point = Point(Point(-1.061105335, -0.2173960398, -0.8062401654))
attractors = Python3Script(tessellation=filter, attractor_point=point)  # -> tessellation, geo; inputs attractor_point: Point3d
# ---------- attractors: Python ----------
from compas_rhino.conversions import line_to_rhino_curve
from compas_rhino.conversions import point_to_compas

# 1. Convert the point or curve from Rhino to COMPAS
# [..ADD YOUR CODE HERE..]

# 2. Copy the tessellation
# [..ADD YOUR CODE HERE..]

# 3. Call the .apply_attractor() method
# [..ADD YOUR CODE HERE..]


# Visualization code
geo = []

for unit in tessellation.units:
    geo.extend(map(line_to_rhino_curve, unit.edges))
    geo.extend([line_to_rhino_curve(segment.line)  for segment in unit.segments])
# ---------- end attractors ----------

# ----
# Colinearity Check
number_slider_3 = Slider(6.2, range=0..20)
collinearity = Script(tessellation=attractors.tessellation, angular_tolerance=number_slider_3, collinear=Toggle(True))  # -> tessellation, geo
# ---------- collinearity: Python ----------
# r: compas>=2.9, compas_timber>=0.14
# venv: ca-fs25

from compas_rhino import DevTools
DevTools.ensure_path()

from compas_rhino.conversions import line_to_rhino_curve, point_to_rhino

import random
import Rhino.Geometry as rg


tessellation = tessellation.copy()

if collinear:
    tessellation.create_rods_from_shared_segments(angular_tolerance)
else:
    tessellation.create_rods_from_single_segments()

geo = []

for rod in tessellation.rods:
    geo.append(line_to_rhino_curve(rod.line))
# ---------- end collinearity ----------

# ---- group: Basic Surface
source_surface = Surface(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)

target_surface = Surface(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)

# ----
# UV Mapping
source_srf = Surface(reparameterize(source_surface))
target_srf = Surface(reparameterize(target_surface))

uv_mapping = Script(tessellation=collinearity.tessellation, source_surface=source_srf, target_surface=target_srf, show_text=Toggle(False))  # -> new_tessellation, geo, graph; inputs source_surface: Surface, target_surface: Surface
# ---------- uv_mapping: Python ----------
# r: compas>=2.9, compas_timber>=0.14
# venv: ca-fs25

from compas_rhino import DevTools
DevTools.ensure_path()

from compas_rhino.conversions import line_to_rhino_curve
from compas_rhino.conversions import point_to_rhino
from compas_rhino.conversions import surface_to_compas
from a03_lift_solution import RFTessellation

import Rhino.Geometry as rg

# 1. Convert source surface to COMPAS
# [..ADD YOUR CODE HERE..]

# 2. Convert target surface to COMPAS
# [..ADD YOUR CODE HERE..]

# 3. Call the method `map_to_surface()` of the tessellation instance
# [..ADD YOUR CODE HERE..]

# 4. Assign the `graph` output variable
# [..ADD YOUR CODE HERE..]


# Visualization code
geo = []

for rod in new_tessellation.rods:
    geo.append(line_to_rhino_curve(rod.line))

for unit in new_tessellation.units:
    if show_text:
        geo.append(rg.TextDot(f"Unit {unit.key}", point_to_rhino(unit.centroid)))
# ---------- end uv_mapping ----------
compas_draw_18 = COMPASDraw(cg=uv_mapping.graph)  # -> rg; same code as compas_draw

# ---- group: Timber Model Mapped
flip_laps = BooleanToggle(False)
apply_joints = BooleanToggle(True)
ct_model_mapped = Python3Script(
    tessellation=uv_mapping.new_tessellation,
    width="0.06",
    height="0.08",
    z_vector="{0,0,1}",
    surface=target_srf,
    flip_lapside=flip_laps,
    create_geometry=apply_joints)  # -> model, tessellation, beams, geometry; inputs width: Double, height: Double, z_vector: Vector3d, surface: Surface, flip_lapside: Boolean, create_geometry: Boolean
# ---------- ct_model_mapped: Python ----------
# r: compas>=2.9, compas_timber>=0.14
# venv: ca-fs25

from compas_rhino import DevTools
DevTools.ensure_path()

from compas_rhino.conversions import vector_to_compas, surface_to_compas
from compas.geometry import Surface

from a03_lift_solution import RFTessellation

# 1. Create beams from rods
z_vector = vector_to_compas(z_vector)

if surface is not None:
    surface = surface_to_compas(surface)
# print(surface)

model = tessellation.generate_beams(width, height, z_vector, surface)
beams = [rod.beam for rod in tessellation.rods]

# 2. Create X-lap joints between consecutive beams
pts1, pts2, cutpln_vec, offset_vec = tessellation.generate_joints_mapped_tessellation(model, flip_lapside)

# 3. Process joinery
if create_geometry:
    model.process_joinery()

geometry = []
for beam in beams:
    if create_geometry:
        geometry.append(beam.geometry)
    else:
        geometry.append(beam.blank)
# ---------- end ct_model_mapped ----------
compas_draw_19 = COMPASDraw(cg=ct_model_mapped.geometry)  # -> rg; same code as compas_draw
preview = CustomPreview(Geometry=compas_draw_19, Material=ColourSwatch(SwatchColor=RGB(176, 163, 146)))

# ---- group: Beam Stats
spruce_kg_m3 = Panel("410")
pt = Point(Point(6.880533775, -3.703653152, 0))
chf_m1 = Slider(4.7, range=0..10)
cut_tolerance = Slider(0.02, range=0..0.15)
beam_analysis = Python3Script(
    tessellation=ct_model_mapped.tessellation,
    origin=pt,
    stock_length=Slider(5, range=0..10),
    safety_dist=cut_tolerance,
    beam_spacing=Slider(0.35, range=0..1),
    safety_margin=Slider(30, range=0..100),
    lm_price=chf_m1,
    transport_cost=Slider(160, range=0..1000),
    wood_density=spruce_kg_m3)  # -> beam_stats, stock_beams, packed_beams; inputs origin: Point3d, stock_length: Double, wood_density: Double
# ---------- beam_analysis: Python ----------
# r: compas>=2.9, compas_timber>=0.14
# venv: ca-fs25

from compas_rhino import DevTools
DevTools.ensure_path()

from compas_rhino.conversions import point_to_compas

# CHALLENGE 01: This code is only calling the method .pack_beams_for_stock_beams()
# which you need to write inside the RFTessellation class!

# Calculate stock usage and visualize

# 1. Convert the origin point to COMPAS
# [..ADD YOUR CODE HERE..]

# 2. Calculate the beam offset from the selected beam spacing
# [..ADD YOUR CODE HERE..]

# 3. Call the method .pack_beams_for_stock_beams() of the tessellation class
# [..ADD YOUR CODE HERE..]


# Generate beam statistics
beam_stats = tessellation.generate_beam_stats(num_stock_beams, stock_length, total_waste, lm_price, transport_cost, wood_density)

# Visualization code
stock_beams = [beam.geometry for beam in stock_beams]
# packed_beams = [beam.geometry for beam in transformed_beams]
packed_beams = transformed_beams
# ---------- end beam_analysis ----------

# ----
draw = COMPASDraw(cg=beam_analysis.stock_beams)  # -> rg; same code as compas_draw
draw_2 = COMPASDraw(cg=beam_analysis.packed_beams)  # -> rg; same code as compas_draw
preview_2 = CustomPreview(Geometry=draw, Material=ColourSwatch(SwatchColor=RGB(163, 140, 119)))
preview_3 = CustomPreview(Geometry=draw_2, Material=ColourSwatch(SwatchColor=RGB(146, 176, 134)))

# ---- group: Visualize
pt_2 = Point(pt)
tag = TextTag3D(
    Location=pt_2,
    Text=beam_analysis.beam_stats,
    Size=Slider(0.2, range=0..1),
    Colour=ColourSwatch(SwatchColor=RGB(87, 87, 87)),
    Justification=8)
