# Grasshopper definition a04_design.ghx (Grasshopper 1.0.8)
# Copyright: ETH Zürich

# ----
# RF Units
number_slider = Slider(3, range=3..20)
# ETH Zürich
# Lecturer: Gonzalo Casas
# Coordination: Lorin Wiedemeier
number_slider_2 = Slider(0.056, range=0..0.5)
rf_unit = Python3Script(
    sides=Slider(8, range=3..20),
    edge_length=Slider(0.65, range=0.1..3),
    start_eccentricity=Slider(0.344, range=-0.5..0.5),
    end_eccentricity=Slider(0, range=-0.5..0.5),
    overlap=number_slider_2)  # -> rfunit, segment_lines, shape_edges; inputs sides: Int32
# ---------- rf_unit: Python ----------
# r: compas, compas_timber
# venv: ca-fs25

from compas_rhino import DevTools
DevTools.ensure_path()

import math

from compas.geometry import Polygon
from a04_design_solution import RFUnit

radius = edge_length / (2 * math.sin(math.pi / sides))
shape = Polygon.from_sides_and_radius_xy(sides, radius)

# 8.2 Create the RFUnit instance
rfunit = RFUnit(shape, start_eccentricity, end_eccentricity, overlap)
rfunit.generate_segments()
rfunit.adjust_segments()

# 8.3 Output the edges and segment lines. You can visualize with the COMPAS Draw component right after
shape_edges = rfunit.edges
segment_lines = [segment.line for segment in rfunit.segments]
# ---------- end rf_unit ----------
rf_unit_2 = Python3Script(
    sides=number_slider,
    edge_length=Slider(0.65, range=0.1..3),
    start_eccentricity=Slider(0.096, range=-0.5..0.5),
    end_eccentricity=Slider(0.11, range=-0.5..0.5),
    overlap=Slider(0.26, range=0..0.5))  # -> rfunit, segment_lines, shape_edges; inputs sides: Int32; same code as rf_unit
rf_unit_3 = Python3Script(
    sides=Slider(4, range=3..20),
    edge_length=Slider(0.65, range=0.1..3),
    start_eccentricity=Slider(0.24, range=-0.5..0.5),
    end_eccentricity=Slider(0.11, range=-0.5..0.5),
    overlap=Slider(0.071, range=0..0.5))  # -> rfunit, segment_lines, shape_edges; inputs sides: Int32; same code as rf_unit
rf_unit_4 = Python3Script(
    sides=Slider(6, range=3..20),
    edge_length=Slider(0.7, range=0.1..3),
    start_eccentricity=Slider(0.38, range=-0.5..0.5),
    end_eccentricity=Slider(0, range=-0.5..0.5),
    overlap=Slider(0.11, range=0..0.5))  # -> rfunit, segment_lines, shape_edges; inputs sides: Int32; same code as rf_unit
compas_draw = COMPASDraw(cg=rf_unit_2.segment_lines)  # -> rg; same code as draw
compas_draw_2 = COMPASDraw(cg=rf_unit_2.shape_edges)  # -> rg; same code as draw
compas_draw_3 = COMPASDraw(cg=rf_unit_3.segment_lines)  # -> rg; same code as draw
compas_draw_4 = COMPASDraw(cg=rf_unit_3.shape_edges)  # -> rg; same code as draw
compas_draw_5 = COMPASDraw(cg=rf_unit_4.segment_lines)  # -> rg; same code as draw
compas_draw_6 = COMPASDraw(cg=rf_unit_4.shape_edges)  # -> rg; same code as draw
compas_draw_7 = COMPASDraw(cg=rf_unit.segment_lines)  # -> rg; same code as draw
compas_draw_8 = COMPASDraw(cg=rf_unit.shape_edges)  # -> rg; same code as draw

# ----
# RF Structures
# A04 Design Project
# Task Description: # Final project
# 
# > Goal: design a reciprocal frame structure located next to the
# [HIN building at ETH Hönggerberg](https://ethz.ch/en/campus/access/hoenggerberg.html)
#  using the knowledge gained during the previous assignments this semester.
# 
# ## Project Overview
# 
# Use Python programming to design a reciprocal frame timber structure based
# on the classes implemented during the semester (`RFUnit`, `RFGrammarRule`,
# `RFTessellation`, etc). The design of the structure should be materialized
# as a timber model, including beams and joints, and should be fabricatable
# (eg. contain no collisions between beams) using a CNC machining process.
# 
# The RF structure is to be placed in at the ETH Hönggerberg, next to
# the **HIN building** (Zero Carbon Building Systems Lab).
# 
# The submitted projects will be evaluated for
# fabricability and aesthetics, and one of them will be
# selected to be fabricated and assembled in real life.
# 
# ### **Site**
# 
#  * **HIN building** (Zero Carbon Building Systems Lab), ETH Hönggerberg
#  * Area: approx. 63 m2
#  * Max height: 2.5m
#  * [Link to Map](https://maps.app.goo.gl/XkUaAZL1iQzD6Pyh9)
#  * [Rhino file](a04_design_base-file.3dm)
# 
# ---
# 
# ## Required tasks
# 
# The following tasks are required to complete the final project
# successfully. Completing them correctly awards 4 grade points.
# The maximum grade for this assignment is 6 points. The remaining
# 2 points can be obtained by completing the extra tasks.
# 
# ### 1. Project presentation: poster in PDF
# 
# Prepare a single-page poster showcasing the project and the outputs of your code.
# 
# Guidelines:
# 
# - Brief description of your design intent. Can highlight concept, challenges faced, and discoveries made during the project.
# - Consider including small snippets of interesting code used in the creation of the project. Code should be formatted in a monospaced font.
# - Main image of the project and optionally large side image.
# - Optionally additional diagrams or images of the project to complement the textual description.
# - Use Landscape orientation
# 
# ### 2. Create an RF structure design and map it to a target surface on-site.
# 
# Use the classes for RF structure design we developed in class during the semester & assignments, and map the resulting tessellation onto a final surface placed on the site indicated above. The mapping of the surface also requires a source surface to act as reference.
# 
# Use the Optimization section to gain precise control over the placement of each beam, if needed.
# 
# ## Deliverables
# 
# One zip file (`mustermann_max_A-04.zip`) containing:
# 
# - Grasshopper File (`.ghx`):
#   - File Name: `mustermann_max_A-04.ghx`
# - Rhino File (`*.3dm`):
#   - File Name: `mustermann_max_A-04.3dm`
#   - Bake building into Rhino: `yes`
# - Python (`*.py`):
#   - File Name: `a04_design_solution.py`
# - Short project presentation / poster (`pdf`):
#   - File Name: `mustermann_max_Final_Project.pdf`
# - Project images (minimum 1) (`png`):
#   - File Name: `mustermann_max_Final_Project_01.png`
#   - Dimensions: 3000x2400px
#   - View: Perspective - rendered
#   - Background: white without grid axes and grid
# 
# ## Submission
# 
# Upload the assignment via Moodle.
# A04 Design Project
code_reloading = BooleanToggle(True)
# Extra Tasks: ## Extra tasks
# 
# The following tasks are not mandatory, but allow you to exercise more the skills you have acquired. Each task grants between 0.25 and 1 grade points. The maximum grade for the final project is 6 points. If all required and extra tasks are completed successfully, the maxium grade of 6 will be awarded.
# 
# ### 1. Attractor-based adjustments (0.25pt)
# 
# Use an attractor point or curve to adjust one or more parameter of the structure, for example, modify the start eccentricity of the units based on the distance to the attractor, as done in A03.
# 
# ### 2. Surface-curvature-based adjustments (0.25pt)
# 
# Similar to the attractor-based adjustments, but instead of attractors, use the curvature of the target surface to adjust local parameters of the structure. Unlike the attractor-based adjustments, this one would need to take place at a later stage in the pipeline, at the point of/or after the UV mapping, which changes the possible parameters that can be adjusted (consider that regenerating segments at this point cannot be done without significant reassignment of other data).
# 
# ### 3. Fabricability checks: minimum eccentricity radius (0.25pt)
# 
# Add a check to ensure that the minimum eccentricity radius is not exceeded.
# Units with a very small inner radius are very likely to be unmanufacturable, or impossible to assemble.
# 
# ### 4. Fabricability checks: ensure no collisions that are not joints (0.5pt)
# 
# Add a check to ensure that no two beams intersect, except those for which a joint exists.
# 
# ### 5. Fabricability checks: minimum and maximum beam length (0.25pt)
# 
# Add a check to ensure that the minimum and maximum beam length are not exceeded. The minimum length of beams is 60cm, and the maximum is 200cm.
# 
# ### 6. Design a boundary (1pt)
# 
# Design a boundary for the structure, either based on a ring, or based on a extending beams to the ground. You might also create a primary or secondary structural system, to hold the RF structure. Keep in mind structural stability and fabricability if you choose to create an additional system.
# 
# ### 7. Add metrics (0.25pt)
# 
# Add one or more metrics that utilize the timber model to extract information, for example, calculate CO2 emmissions of the material in your structure (use 90 CO2m/m3 per kg of timber).
# 
# ### 8. Integrate other joint types in your design (0.25pt)
# 
# Integrate other joint types in your design, for example, T-Butt joints, either assignming them per unit, or per segments, or any other way that allows you to play with options of using other joint types.
# 
# ### 9. Roof cladding (1pt)
# 
# Develop a roof cladding system for the reciprocal frame structure. You'll need to think about the geometry of the structure, and how to attach the cladding to the structure.
# 
# ### 10. Assembly sequencing (1pt)
# 
# Leverage the algorithms available for graphs in COMPAS, to determine an ordering of beams that allows for a sequential assembly of the structure.
# 
# For example, use `compas.topology.breadth_first_ordering` to get a sequencial order of beams starting from the most central unit.
# 
# ### 11. Add a cut plane to trim the entire structure (0.5pt)
# 
# If it makes sense for your structure Use the features of `compas_timber` to add a cut plane to trim the entire structure. The cut plane can be as a horizontal plane that is parallel to the ground.
reload = Script(enabled=code_reloading)
# ---------- reload: Python ----------
# r: compas>=2.9, compas_timber>=0.14
# venv: ca-fs25

from compas_rhino.devtools import DevTools
if enabled:
    DevTools.enable_reloader()
else:
    DevTools.disable_reloader()
# ---------- end reload ----------

# ---- group: 3.3
# RF Grammar Rules
number_slider_3 = Slider(0, range=0..6)
rule = Script(unit1=rf_unit_2.rfunit, edge1=number_slider_3, edge2=Slider(0, range=0..6), mirror=Toggle(True))  # -> rule, geo; inputs edge1: Int32, edge2: Int32
# ---------- rule: Python ----------
# r: compas, compas_timber
# venv: ca-fs25

from compas_rhino import DevTools
DevTools.ensure_path()

from a04_design_solution import RFGrammarRule


rule = RFGrammarRule(unit1, unit2, edge1, edge2, mirror)
new_unit = rule.apply_rule(edge1, edge2, mirror)

geo = []
shape_edges = unit1.edges + new_unit.edges
segment_lines = [segment.line for segment in unit1.segments]
segment_lines += [segment.line for segment in new_unit.segments]
geo = shape_edges + segment_lines
# ---------- end rule ----------
compas_draw_9 = COMPASDraw(cg=rule.geo)  # -> rg; same code as draw

# ---- group: 3.6
rule_2 = Script(
    unit1=rf_unit_2.rfunit,
    unit2=rf_unit_4.rfunit,
    edge1=Slider(0, range=0..6),
    edge2=Slider(0, range=0..6),
    mirror=Toggle(False))  # -> rule, geo; inputs edge1: Int32, edge2: Int32; same code as rule
compas_draw_10 = COMPASDraw(cg=rule_2.geo)  # -> rg; same code as draw

# ---- group: 4.4
rule_3 = Script(unit1=rf_unit_3.rfunit, edge1=Slider(0, range=0..6), edge2=Slider(0, range=0..6), mirror=Toggle(True))  # -> rule, geo; inputs edge1: Int32, edge2: Int32; same code as rule
compas_draw_11 = COMPASDraw(cg=rule_3.geo)  # -> rg; same code as draw

# ---- group: 4.6
rule_4 = Script(
    unit1=rf_unit_3.rfunit,
    unit2=rf_unit_4.rfunit,
    edge1=Slider(0, range=0..6),
    edge2=Slider(0, range=0..6),
    mirror=Toggle(True))  # -> rule, geo; inputs edge1: Int32, edge2: Int32; same code as rule
compas_draw_12 = COMPASDraw(cg=rule_4.geo)  # -> rg; same code as draw

# ---- group: 6.6
rule_5 = Script(unit1=rf_unit_4.rfunit, edge1=Slider(0, range=0..6), edge2=Slider(0, range=0..6), mirror=Toggle(True))  # -> rule, geo; inputs edge1: Int32, edge2: Int32; same code as rule
compas_draw_13 = COMPASDraw(cg=rule_5.geo)  # -> rg; same code as draw

# ---- group: 4.8
rule_6 = Script(
    unit1=rf_unit_3.rfunit,
    unit2=rf_unit.rfunit,
    edge1=Slider(0, range=0..6),
    edge2=Slider(0, range=0..6),
    mirror=Toggle(True))  # -> rule, geo; inputs edge1: Int32, edge2: Int32; same code as rule
compas_draw_14 = COMPASDraw(cg=rule_6.geo)  # -> rg; same code as draw

# ---- group: 3.4
rule_7 = Script(
    unit1=rf_unit_2.rfunit,
    unit2=rf_unit_3.rfunit,
    edge1=Slider(0, range=0..6),
    edge2=Slider(0, range=0..6),
    mirror=Toggle(True))  # -> rule, geo; inputs edge1: Int32, edge2: Int32; same code as rule
compas_draw_15 = COMPASDraw(cg=rule_7.geo)  # -> rg; same code as draw

# ---- group: 6.8
rule_8 = Script(
    unit1=rf_unit_3.rfunit,
    unit2=rf_unit.rfunit,
    edge1=Slider(0, range=0..6),
    edge2=Slider(0, range=0..6),
    mirror=Toggle(True))  # -> rule, geo; inputs edge1: Int32, edge2: Int32; same code as rule
compas_draw_16 = COMPASDraw(cg=rule_8.geo)  # -> rg; same code as draw

# ----
merge = Merge(
    Data1=rule.rule,
    Data2=rule_7.rule,
    Data3=rule_2.rule,
    Data4=rule_3.rule,
    Data5=rule_4.rule,
    Data6=rule_5.rule,
    Data7=rule_6.rule,
    Data8=rule_8.rule)

# ---- group: 2. Set file name
panel = Panel("mustermann_max")
panel_2 = Panel("A04_")

# ---- group: 3. Click button to save image
button = Button()

# ---- group: 1. Select target directory
# Submission Image
path = FilePath()

# ---- group: Single Cycle
value_list = ValueList({"(3, 3, 3, 3, 3, 3)", "(4, 4, 4, 4)", "(3, 6, 3, 6)", "(6, 6, 6)"}, selected="(3, 6, 3, 6)")
# RF Tessellation
data = Data(rule_2.rule)
tessellate_single_cycle = Script(rules=data, vertex_config=value_list, show_text=Toggle(False))  # -> tessellation, geo; inputs rules: list
# ---------- tessellate_single_cycle: Python ----------
# r: compas, compas_timber
# venv: ca-fs25

from compas_rhino import DevTools
DevTools.ensure_path()

from compas_rhino.conversions import line_to_rhino_curve, point_to_rhino
from a04_design_solution import RFTessellation

import random
import Rhino.Geometry as rg

vertex_config = eval(vertex_config)

tessellation = RFTessellation(vertex_configuration=vertex_config)
tessellation.apply_rules_cycle(rules)

geo = []

for unit in tessellation.units:
    geo.extend(map(line_to_rhino_curve, unit.edges))
    geo.extend([line_to_rhino_curve(segment.line)  for segment in unit.segments])

    if show_text:
        dot = rg.TextDot(f"Unit={unit.key}", point_to_rhino(unit.centroid))
        geo.append(dot)

        for e, cp in enumerate(unit.connection_points):
            dot = rg.TextDot(f"E={unit.key}/{e}", point_to_rhino(cp.point - cp.vector/100.))
            geo.append(dot)
# ---------- end tessellate_single_cycle ----------

# ---- group: Iterative Tessellation
value_list_2 = ValueList({"(3, 3, 3, 3, 3, 3)", "(4, 4, 4, 4)", "(3, 6, 3, 6)", "(6, 6, 6)"}, selected="(6, 6, 6)")
data_2 = Data(merge)
tessellate_iteratively = Script(rules=data_2, vertex_config=value_list_2, max_iterations=Slider(20, range=1..150), show_text=Toggle(False))  # -> tessellation, geo, graph; inputs rules: list, max_iterations: Int32
# ---------- tessellate_iteratively: Python ----------
# r: compas, compas_timber
# venv: ca-fs25

from compas_rhino import DevTools
DevTools.ensure_path()

from compas_rhino.conversions import line_to_rhino_curve, point_to_rhino
from a04_design_solution import RFTessellation

import random
import Rhino.Geometry as rg

vertex_config = eval(vertex_config)

tessellation = RFTessellation(vertex_configuration=vertex_config)
tessellation.tessellate(rules, max_iterations=max_iterations)

graph = tessellation.graph

geo = []

for unit in tessellation.units:
    geo.extend(map(line_to_rhino_curve, unit.edges))
    geo.extend([line_to_rhino_curve(segment.line)  for segment in unit.segments])

    if show_text:
        dot = rg.TextDot(f"Unit={unit.key}", point_to_rhino(unit.centroid))
        geo.append(dot)

    # for e, cp in enumerate(unit.connection_points):
    #     dot = rg.TextDot(f"E={unit.key}/{e}", point_to_rhino(cp.point - cp.vector/100.))
    #     geo.append(dot)
# ---------- end tessellate_iteratively ----------
compas_draw_17 = COMPASDraw(cg=tessellate_iteratively.graph)  # -> rg; same code as draw

# ----
screenshot_tool = GhPythonScript(
    path=path,
    name=panel,
    assignment_nr=panel_2,
    width="3200",
    height="2400",
    display_grid="False",
    display_grid_axes="False",
    save=button)  # -> out; inputs width: Int32, height: Int32, display_grid: Boolean, display_grid_axes: Boolean
# ---------- screenshot_tool: Python ----------
import Rhino.Display as rd
import scriptcontext as sc
import System
import os

file_name = name + "_" + assignment_nr

def get_next_index(path):
    index = 1
    while os.path.exists(path + file_name + str(index) + ".png"):
        index += 1
    return index

def ViewCaptureToFile(path):
    view = sc.doc.Views.ActiveView
    if view:
        view_capture = rd.ViewCapture()
        view_capture.TransparentBackground = False
        view_capture.Width = view.ActiveViewport.Size.Width
        view_capture.Height = view.ActiveViewport.Size.Width
        view_capture.ScaleScreenItems = False
        view_capture.DrawAxes = True
        view_capture.DrawGrid = display_grid
        view_capture.DrawGridAxes = display_grid_axes
        size = System.Drawing.Size(view_capture.Width, view_capture.Height)
        size = System.Drawing.Size(width, height)
        
        settings = rd.ViewCaptureSettings(view, size, 72) # view, size, dpi
        settings.RasterMode = True
        settings.DrawGrid = False
        settings.DrawAxis = False
        settings.DrawWallpaper = False
        index = get_next_index(path)
            
        filename = file_name + str(index)
        filename_with_extension = filename + ".png"
        bitmap = rd.ViewCapture.CaptureToBitmap(settings)
        fullpath = path + filename_with_extension
        bitmap.Save(fullpath)
        
        return filename_with_extension
        
        
if path is None:
    ghenv.Component.Message = "Select a target directory first"
else:
    if save:
        path = ViewCaptureToFile(path)
        ghenv.Component.Message = "Saved image to " + path
# ---------- end screenshot_tool ----------

list = ValueList({"Single Cycle": 0, "Iterative": 1}, selected="Iterative")
filter = StreamFilter(Gate=list, Stream0=tessellate_single_cycle.tessellation, Stream1=tessellate_iteratively.tessellation)

# ----
# Colinearity Check
number_slider_4 = Slider(6.2, range=0..20)
collinearity = Script(tessellation=filter, angular_tolerance=number_slider_4, collinear=Toggle(True))  # -> tessellation, geo
# ---------- collinearity: Python ----------
# r: compas, compas_timber
# venv: ca-fs25

from compas_rhino import DevTools
DevTools.ensure_path()

from compas_rhino.conversions import line_to_rhino_curve, point_to_rhino

import random
import Rhino.Geometry as rg


tessellation = tessellation.copy()

if collinear:
    tessellation.create_rods_from_shared_segments(angular_tolerance)
else:
    tessellation.create_rods_from_single_segments()

geo = []

for rod in tessellation.rods:
    geo.append(line_to_rhino_curve(rod.line))
# ---------- end collinearity ----------

# ----
# Source Geometry
# Example
source_surface = Surface(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)

target_surface = Surface(<surface referenced from the Rhino model>)

# ----
# Your Design
source_surface_2 = Surface(<surface referenced from the Rhino model>)

# ----
# Main Task
target_surface_2 = Surface(<surface referenced from the Rhino model>)

reverse_srf = ReverseSurface(Surface=source_surface_2, U=Toggle(False), V=Toggle(True), W=Toggle(False), ShowArrows=True)

reverse_srf_2 = ReverseSurface(Surface=target_surface_2, U=Toggle(False), V=Toggle(False), W=Toggle(False), ShowArrows=True)

# ----
# UV Mapping
source_srf = Surface(reparameterize(reverse_srf))
target_srf = Surface(reparameterize(reverse_srf_2))

uv_mapping = Script(tessellation=collinearity.tessellation, source_surface=source_srf, target_surface=target_srf, show_text=Toggle(False))  # -> new_tessellation, geo, graph; inputs source_surface: Brep, target_surface: Brep
# ---------- uv_mapping: Python ----------
# r: compas, compas_timber
# venv: ca-fs25

from compas_rhino import DevTools
DevTools.ensure_path()

from compas.geometry import Brep
from compas_rhino.conversions import surface_to_compas, line_to_rhino_curve, point_to_rhino
from a04_design_solution import RFTessellation

import Rhino.Geometry as rg

source_brep = Brep.from_native(source_surface)
target_brep = Brep.from_native(target_surface)

new_tessellation = tessellation.map_to_surface(source_brep, target_brep)
graph = new_tessellation.graph

geo = []

for rod in new_tessellation.rods:
    geo.append(line_to_rhino_curve(rod.line))

# for unit in new_tessellation.units:
#     geo.extend(map(line_to_rhino_curve, unit.edges))

#     if show_text:
#         dot = rg.TextDot(f"Unit={unit.key}", point_to_rhino(unit.centroid))
#         geo.append(dot)
# ---------- end uv_mapping ----------
compas_draw_18 = COMPASDraw(cg=uv_mapping.graph)  # -> rg; same code as draw

# ---- group: Optimization
# Optimization
grab = BooleanToggle(False)
reset = Button()
on_off = BooleanToggle(True)

dam = DataDam(DataA=uv_mapping.new_tessellation, BufferDelay=10000000, BufferMode=0)
connectivity = Python3Script(tessellation=dam)  # -> rod_curves, conn_A, conn_B
# ---------- connectivity: Python ----------
# r: compas>=2.9, compas_timber
# venv: ca-fs25

from compas_rhino import DevTools
DevTools.ensure_path()

# from reciprocal_frames import compute_rod_connectivity
from compas_rhino.conversions import line_to_rhino_curve


def compute_rod_connectivity(tessellation, tolerance=1e-6):
    """
    Computes connectivity between rods based on the ordering of segments in each RFUnit.
    Returns two lists, A and B, where each pair (A[k], B[k]) indicates that the rod with
    index A[k] is connected to the rod with index B[k] in that RFUnit.
    """

    tesselation = tessellation.copy()

    # Build a mapping from all rods referenced in the RFUnit segments to a unique index.
    rod_set = {}
    for unit in tessellation.units:
        for seg in unit.segments:
            if seg.rod is not None:
                rod_set[id(seg.rod)] = seg.rod

    rod_index = {rid: idx for idx, rid in enumerate(rod_set.keys())}

    connectivity_A = []
    connectivity_B = []

    # Now iterate over each unit and use the rods that appear in its segments.
    for unit in tessellation.units:
        unit_rod_indices = []
        for seg in unit.segments:
            if seg.rod is not None:
                # Only add if this rod's id is in our mapping.
                rod_id = id(seg.rod)
                if rod_id in rod_index:
                    unit_rod_indices.append(rod_index[rod_id])
                else:
                    # Optionally, log that a segment’s rod wasn’t found in the global mapping.
                    print(f"Warning: rod with id {rod_id} not found in global mapping.")
        n = len(unit_rod_indices)
        if n < 2:
            continue  # Not enough rods in this unit to form a connection.
        # For each rod in the unit, pair it with the next one (wrap around at the end).
        for i in range(n):
            j = (i + 1) % n
            connectivity_A.append(unit_rod_indices[i])
            connectivity_B.append(unit_rod_indices[j])

    return connectivity_A, connectivity_B


# -----------------------------------------------
# ------------------ Execution ------------------

# Usage example:
rods = tessellation.rods
rod_curves = [line_to_rhino_curve(rod.line) for rod in rods]

conn_A, conn_B = compute_rod_connectivity(tessellation)
print("Connectivity A:", conn_A)
print("Connectivity B:", conn_B)
# ---------- end connectivity ----------
grab_2 = Grab(On=grab, Strength=1, Range=1)
# - trigger data-dam
# - toggle grab on
# - hit RESET
# - adjust beams to taste
# - toggle grab off
# 
# (or bypass optimization)
goals = Goals(line=connectivity.rod_curves, relay=grab_2, connectivity_a=connectivity.conn_A, connectivity_b=connectivity.conn_B)  # -> goals_2, radius
bouncysolver = BouncySolver(
    GoalObjects=goals.goals_2,
    Reset=reset,
    Threshold="0.000000000010",
    Tolerance=Slider(0.001, range=0..0.001),
    Damping=Slider(0.37, range=0..1),
    Iterations=Slider(24, range=0..40),
    On=on_off)  # -> I, V, O

dot = DotDisplay(Point=bouncysolver.V)
pipe = Pipe(Curve=bouncysolver.O, Radius=goals.radius, Caps=0)  # -> flatten(Pipe)
clean = CleanTree(RemoveNulls=True, RemoveInvalid=True, RemoveEmpty=False, Tree=bouncysolver.O)
colourful = Colourful(geo=pipe)

# ----
dam_2 = DataDam(DataA=clean, BufferDelay=10000000, BufferMode=0)
update_rods = Python3Script(tessellation=uv_mapping.new_tessellation, optimized_rods=dam_2)  # -> new_tessellation; inputs optimized_rods: list of Line
# ---------- update_rods: Python ----------
# r: compas>=2.9, compas_timber
# venv: ca-fs25

from compas_rhino import DevTools
DevTools.ensure_path()

from a04_design_solution import RFTessellation

from compas_rhino.conversions import line_to_compas

def reconstruct_tessellation(tessellation, rod_lines):
    # this function updates an existing tessellation by replacing the existing rod lines with the new ones
    # replacement is by index

    # create new tessellation
    tesselation = tessellation.copy()
    
    # replace rod lines
    rods = tesselation.rods

    rod_lines = [line_to_compas(line) for line in rod_lines]
    
    for i, rod_line in enumerate(rod_lines):
        if i < len(rods):
            rod = rods[i]
            
            # Update the rod segments based on the new rod line
            if rod.segment2 is not None:
                # For rods with two segments
                # Update the first segment
                rod.segment1.start = rod_line.start
                rod.segment1.end = rod_line.midpoint
                
                # Update the second segment
                rod.segment2.start = rod_line.end
                rod.segment2.end = rod_line.midpoint
            else:
                # For rods with a single segment
                rod.segment1.start = rod_line.start
                rod.segment1.end = rod_line.end
    
    return tesselation




new_tessellation = reconstruct_tessellation(tessellation, optimized_rods)
# ---------- end update_rods ----------

# ---- group: Timber Model Planar
flip_laps = BooleanToggle(True)  # disabled
apply_joints = BooleanToggle(False)  # disabled
# Compas Timber Model
panel_3 = Panel("0.06")  # disabled
panel_4 = Panel("0.08")  # disabled
panel_5 = Panel("{0,0,1}")  # disabled
# Additional Task
ct_model_planar = Python3Script(
    tessellation=collinearity.tessellation,
    width=panel_3,
    height=panel_4,
    z_vector=panel_5,
    flip_lapside=flip_laps,
    create_geometry=apply_joints)  # -> model, geometry, beams; inputs width: Double, height: Double, z_vector: Vector3d, flip_lapside: Boolean, create_geometry: Boolean; disabled
# ---------- ct_model_planar: Python ----------
# r: compas, compas_timber
# venv: ca-fs25

from compas_rhino import DevTools
DevTools.ensure_path()

from compas_rhino.conversions import vector_to_compas

# 1. Create beams from rods
z_vector = vector_to_compas(z_vector)
model = tessellation.generate_beams(width, height, z_vector)
beams = [rod.beam for rod in tessellation.rods]

# 2. Create X-lap joints between consecutive beams
tessellation.generate_joints(model, flip_lapside)

# 3. Process joinery
if create_geometry:
    model.process_joinery()

geometry = []
for beam in beams:
    if create_geometry:
        geometry.append(beam.geometry)
    else:
        geometry.append(beam.blank)
# ---------- end ct_model_planar ----------
swatch = ColourSwatch(SwatchColor=RGB(176, 163, 146))  # disabled
compas_draw_19 = COMPASDraw(cg=ct_model_planar.geometry)  # -> rg; disabled; same code as draw
preview = CustomPreview(Geometry=compas_draw_19, Material=swatch)  # disabled

# ---- group: Timber Model Mapped
apply_joints_2 = BooleanToggle(False)
flip_laps_2 = BooleanToggle(False)
cutting_plane = Plane(PlaneXY(0, 0, 0))
ct_model_mapped = Python3Script(
    tessellation=update_rods,
    width="0.06",
    height="0.08",
    z_vector="{0,0,1}",
    surface=target_srf,
    flip_lapside=flip_laps_2,
    create_geometry=apply_joints_2,
    cut_plane=cutting_plane)  # -> model, beams, geometry; inputs width: Double, height: Double, z_vector: Vector3d, surface: Surface, flip_lapside: Boolean, create_geometry: Boolean, cut_plane: Plane
# ---------- ct_model_mapped: Python ----------
# r: compas, compas_timber
# venv: ca-fs25

from compas_rhino import DevTools
DevTools.ensure_path()

# ------------------------------------------------------
# Imports
# ------------------------------------------------------

from compas_rhino.conversions import vector_to_compas, surface_to_compas
from compas.geometry import Surface

from a04_design_solution import RFTessellation

# ------------------------------------------------------
# Execution
# ------------------------------------------------------

# 0. initial setup
z_vector = vector_to_compas(z_vector)
if surface is not None:
    surface = surface_to_compas(surface)

# 1. Create beams from rods
model = tessellation.generate_beams(width, height, z_vector, surface)

# 2. Create X-lap joints between consecutive beams
tessellation.generate_joints_mapped_tessellation(model, flip_lapside)

# 3. ADDITIONAL TASK: Add Cut Plane
    # trim all beams with the cut_plane input.
    # keep in mind the normal direction of the plane, flip it if necessary.

    # your code here...

# 3. Output beams
beams = [rod.beam for rod in tessellation.rods]

# 4. Process joinery
if create_geometry:
    model.process_joinery()

# 5. Output Geometry
geometry = []
for beam in beams:
    if create_geometry:
        geometry.append(beam.geometry)
    else:
        geometry.append(beam.blank)
# ---------- end ct_model_mapped ----------
compas_draw_20 = COMPASDraw(cg=ct_model_mapped.geometry)  # -> rg; same code as draw
preview_2 = CustomPreview(Geometry=compas_draw_20, Material=ColourSwatch(SwatchColor=RGB(176, 163, 146)))

# ----
# Manual Adjustments
pipeline = GeometryPipeline(
    GroupByLayer=False,
    GroupByType=False,
    IncludeHidden=True,
    IncludeLocked=True,
    LayerFilter="**::manual-beams",
    NameFilter="*",
    SublayerFiltering=True,
    TypeFilter=4)
# Additional Task
custom_beams = Python3Script(model=ct_model_mapped.model, custom_lines=pipeline)  # -> out, Model, Beams, geometry; inputs custom_lines: list of Line
# ---------- custom_beams: Python ----------
from compas_rhino import DevTools
DevTools.ensure_path()

from compas.geometry import Line, Point, Polygon, Vector, Frame
from compas.geometry import Transformation, Translation
from compas.geometry import intersection_line_line
from compas_rhino.conversions import line_to_compas

from compas.tolerance import TOL
from compas.datastructures import Graph

from compas_timber.connections import XLapJoint, TButtJoint, TLapJoint

from compas_timber.elements import Beam
from compas_timber.model import TimberModel

# Create a copy of the model to work with
model_temp = model.copy()
z_vec = Vector(0, 0, 1)

# List to store newly created beams
new_beams = []

# ADDITIONAL TASK: Add new beams from custom lines

if custom_lines is not None:
    # your code goes here
    # ...
    # ...
    # ...
    pass

# Process all joinery in the model
model_temp.process_joinery()

Beams = [beam for beam in model_temp.beams]

# Collect geometries for output
geometry = []
for beam in model_temp.beams:
    geometry.append(beam.geometry)

# return geometry
# ---------- end custom_beams ----------

# ----
# Useful Tools
detessellation = Python3Script(tessellation=update_rods)  # -> out, shapes, segments, rods, connection_points; disabled
# ---------- detessellation: Python ----------
# r: libigl, compas>=2.9, compas_timber
# venv: ca-fs25

from compas_rhino import DevTools
DevTools.ensure_path()

def deconstruct_tessellation(tessellation):
    from compas_rhino.conversions import line_to_rhino
    from compas_rhino.conversions import point_to_rhino
    from compas_rhino.conversions import polyline_to_rhino
    from compas.geometry import Line, Point, Polyline
    
    # Initialize result containers
    shapes = []
    segments = []
    rods = []
    connection_points = []
    
    # Process each unit in the tessellation
    for unit in tessellation.units:
        # 1. Convert unit shape (if it exists)
        if hasattr(unit, 'shape') and unit.shape and hasattr(unit.shape, 'vertices'):
            # Create a closed polyline from the shape vertices
            vertices = unit.shape.vertices + [unit.shape.vertices[0]]  # Close the shape
            shape_polyline = Polyline(vertices)
            shapes.append(polyline_to_rhino(shape_polyline))
        
        # 2. Convert segments
        for segment in unit.segments:
            # Create a COMPAS line from segment endpoints
            segment_line = Line(segment.start, segment.end)
            segments.append(line_to_rhino(segment_line))
        
        # 3. Convert connection points
        if hasattr(unit, 'connection_points') and unit.connection_points:
            for cp in unit.connection_points:
                if hasattr(cp, 'point') and cp.point is not None:
                    # Convert COMPAS point to Rhino point
                    connection_points.append(point_to_rhino(cp.point))
    
    # 4. Convert rods using tessellation's rods property
    for rod in tessellation.rods:
        rods.append(line_to_rhino(rod.line))

    return shapes, segments, rods, connection_points

shapes, segments, rods, connection_points = deconstruct_tessellation(tessellation)
# ---------- end detessellation ----------
debeams = Python3Script(beams=custom_beams.Beams)  # -> centerlines, frames, blanks, geometries, top_faces, names, flags; inputs beams: list; disabled
# ---------- debeams: Python ----------
import Rhino.Geometry as rg
from compas.geometry import Line, Frame
from compas_rhino.conversions import line_to_rhino, frame_to_rhino, brep_to_rhino, box_to_rhino
from compas.scene import Scene

def decompose_and_convert_beams(beams):
    centerlines = []
    frames = []
    blanks = []
    geometries = []
    names = []
    flags_list = []
    top_faces = []

    for beam in beams:
        # Convert centerline to Rhino Curve
        centerline_rhino = None
        if hasattr(beam, "centerline"):
            centerline_rhino = line_to_rhino(Line(beam.centerline.start, beam.centerline.end))
        centerlines.append(centerline_rhino)

        # Convert frame to Rhino Plane
        frame_rhino = None
        if hasattr(beam, "frame"):
            frame_rhino = frame_to_rhino(Frame(beam.frame.point, beam.frame.xaxis, beam.frame.yaxis))
        frames.append(frame_rhino)

        # Convert blank to Rhino Brep
        blank_rhino = None
        if getattr(beam, "blank", None):
            blank_rhino = box_to_rhino(beam.blank)
        blanks.append(blank_rhino)

        # Convert full beam geometry to Rhino Brep
        geom_rhino = None
        geom_compas = None
        if hasattr(beam, "geometry"):
            geom_rhino = brep_to_rhino(beam.geometry)
            geom_comaps = beam.geometry
        geometries.append(geom_rhino)

        # Extract name from assembly_name
        assembly_name = getattr(beam, "assembly_name", f"Beam_{beams.index(beam)}")
        names.append(assembly_name)

        top_face = beam.faces[3]
        top_faces.append(top_face)


        # Extract flags as readable text
        flag_texts = []
        if getattr(beam, "do_not_produce", False):
            flag_texts.append("DO NOT PRODUCE")
        if getattr(beam, "to_be_discarded", False):
            flag_texts.append("TO BE DISCARDED")
        
        flags_list.append(", ".join(flag_texts) if flag_texts else "OK")

    return centerlines, frames, blanks, geometries, names, flags_list, top_faces


# ------------------------------------------------------------------
# Execution
# ------------------------------------------------------------------


# Convert beams to Rhino-compatible geometry
centerlines, frames, blanks, geometries, names, flags, top_faces = decompose_and_convert_beams(beams)
# ---------- end debeams ----------

draw = COMPASDraw(cg=custom_beams.geometry)  # -> rg; same code as draw
dam_3 = DataDam(DataA=custom_beams.Beams, BufferDelay=10000000, BufferMode=0)

# ---- group: Beam Packing
pt = Point(Point(8.185413339, -6.051925847, 0))
cut_tolerance = Slider(0.02, range=0..0.15)
chf_m1 = Slider(4.7, range=0..10)
spruce_kg_m³ = Panel("410")
beam_analysis = Python3Script(
    beams=dam_3,
    origin=pt,
    stock_length=Slider(5, range=0..10),
    safety_dist=cut_tolerance,
    beam_spacing=Slider(0.35, range=0..1),
    safety_margin=Slider(30, range=0..100),
    lm_price=chf_m1,
    transport_cost=Slider(160, range=0..1000),
    wood_density=spruce_kg_m³)  # -> beam_stats, stock_beams, packed_beams; inputs beams: list, origin: Point3d, stock_length: Double, wood_density: Double
# ---------- beam_analysis: Python ----------
# r: compas>=2.9, compas_timber>=0.14
# venv: ca-fs25

from compas_rhino import DevTools
DevTools.ensure_path()

# ------------ Imports ------------

from compas.geometry import Point
from a04_design_solution import pack_beams_for_stock_beams, generate_beam_stats


# ===================================================================
# ---------------------------- Execution ----------------------------
# ===================================================================

# Calculate stock usage and visualize
origin = Point(*origin)
beam_offset = beam_spacing / 2
num_stock_beams, stock_beams, transformed_beams, total_waste = pack_beams_for_stock_beams(
    beams, origin, stock_length, safety_dist, beam_spacing, beam_offset
)

beam_stats = generate_beam_stats(beams, num_stock_beams, stock_length, total_waste, lm_price, transport_cost, wood_density)

stock_beams = [beam.geometry for beam in stock_beams]
# packed_beams = [beam.geometry for beam in transformed_beams]
packed_beams = transformed_beams
# ---------- end beam_analysis ----------
panel_6 = Panel(beam_analysis.beam_stats)

# ---- group: 3D Print Pipeline
beams = Data(dam_3)
build_plate_mm = Slider(255, range=0..1000)
margin_mm = Slider(18, range=0..100)
scale_ratio_1_x = Slider(15, range=0..100)
_3d_print_pipeline = Python3Script(
    beams=beams,
    plate_width=build_plate_mm,
    plate_depth=build_plate_mm,
    margin=margin_mm,
    scale_ratio=scale_ratio_1_x,
    spacing_factor=Slider(2, range=0..10))  # -> out, plate_count, plate_rectangles, plates, beam_geometries, beam_top_faces, beam_names, calculations; inputs beams: list, plate_width: Double, plate_depth: Double, margin: Double, scale_ratio: Double, spacing_factor: Double
# ---------- _3d_print_pipeline: Python ----------
import math
import Rhino.Geometry as rg
from compas.geometry import Frame, Transformation, Box, Scale, Translation, Rotation
from compas.geometry import Vector, Point, Plane, Polygon, Brep
from compas_timber.elements import Beam as CTBeam
from compas_timber.model import TimberModel

def decompose_beams(beams):
    """Extract essential attributes from beams"""
    result = {
        'centerlines': [],
        'frames': [],
        'blanks': [],
        'geometries': [],
        'widths': [],
        'heights': [],
        'top_faces': [],  # Add top faces to the extraction
        'names': []       # Add names to the extraction
    }
    
    for i, beam in enumerate(beams):
        # Extract centerline
        if hasattr(beam, "centerline"):
            result['centerlines'].append(beam.centerline)
        else:
            result['centerlines'].append(None)
        
        # Extract frame
        if hasattr(beam, "frame"):
            result['frames'].append(beam.frame)
        else:
            result['frames'].append(None)
        
        # Extract blank
        if hasattr(beam, "blank"):
            result['blanks'].append(beam.blank)
        else:
            result['blanks'].append(None)
        
        # Extract geometry
        if hasattr(beam, "geometry"):
            result['geometries'].append(beam.geometry)
        else:
            result['geometries'].append(None)
        
        # Extract top face
        if hasattr(beam, "faces") and len(beam.faces) > 3:
            result['top_faces'].append(beam.faces[0])
        else:
            result['top_faces'].append(None)
        
        # Extract name
        assembly_name = getattr(beam, "assembly_name", f"{i}")
        result['names'].append(assembly_name)
        
        # Extract dimensions
        result['widths'].append(beam.width if hasattr(beam, "width") else None)
        result['heights'].append(beam.height if hasattr(beam, "height") else None)
    
    return result

def transform_beam_components(beam_components, scale_ratio=20):
    # Scale factor is 1/scale_ratio (e.g., 1:20 scale = 0.05 scale factor)
    scale_factor = 1.0 / float(scale_ratio)
    
    print(f"Transforming beam components with scale factor: {scale_factor} (1:{scale_ratio})")
    
    # Create a new dictionary to store the transformed components
    transformed_components = {
        'centerlines': [],
        'frames': [],
        'blanks': [],
        'geometries': [],
        'widths': [],
        'heights': [],
        'lengths': [],  # Store the scaled lengths for layout
        'top_faces': [],  # Add top faces to the transformation
        'names': []       # Add names to the transformation
    }
    
    # Get the number of beams
    num_beams = len(beam_components['centerlines'])
    
    # Process each beam
    for i in range(num_beams):
        try:
            # Get beam components
            centerline = beam_components['centerlines'][i]
            frame = beam_components['frames'][i]
            blank = beam_components['blanks'][i]
            geometry = beam_components['geometries'][i]
            width = float(beam_components['widths'][i]) if beam_components['widths'][i] is not None else 0
            height = float(beam_components['heights'][i]) if beam_components['heights'][i] is not None else 0
            top_face = beam_components['top_faces'][i]
            name = beam_components['names'][i]
            
            # Calculate beam length from centerline
            beam_length = float(centerline.length) if centerline else 0
            
            print(f"Beam {i}: original length={beam_length}m, width={width}m, height={height}m")
            
            # Create a target frame where z-axis is aligned with global x-axis
            # This means: x → y, y → z, z → x
            target_point = Point(0, 0, 0)
            target_xaxis = Vector(0, 1, 0)  # Current y becomes new x
            target_yaxis = Vector(0, 0, 1)  # Current z becomes new y
            target_frame = Frame(target_point, target_xaxis, target_yaxis)
            
            # Create transformation from current frame to target frame
            frame_transform = Transformation.from_frame_to_frame(frame, target_frame)
            
            # Apply scaling transformation
            scale_transform = Scale.from_factors([scale_factor, scale_factor, scale_factor])
            
            # Apply frame alignment transformation to all components
            new_frame = frame.transformed(frame_transform) if frame else None
            new_centerline = centerline.transformed(frame_transform) if centerline else None
            new_blank = blank.transformed(frame_transform) if blank else None
            new_geometry = geometry.transformed(frame_transform) if geometry else None
            new_top_face = top_face.transformed(frame_transform) if top_face else None
            
            # Apply scaling transformation to all components
            new_frame = new_frame.transformed(scale_transform) if new_frame else None
            new_centerline = new_centerline.transformed(scale_transform) if new_centerline else None
            new_blank = new_blank.transformed(scale_transform) if new_blank else None
            new_geometry = new_geometry.transformed(scale_transform) if new_geometry else None
            new_top_face = new_top_face.transformed(scale_transform) if new_top_face else None
            
            # Calculate scaled dimensions
            scaled_width = width * scale_factor
            scaled_height = height * scale_factor
            scaled_length = beam_length * scale_factor
            
            print(f"Beam {i}: scaled length={scaled_length}m, width={scaled_width}m, height={scaled_height}m")
            
            # Add the transformed components to our lists
            transformed_components['centerlines'].append(new_centerline)
            transformed_components['frames'].append(new_frame)
            transformed_components['blanks'].append(new_blank)
            transformed_components['geometries'].append(new_geometry)
            transformed_components['top_faces'].append(new_top_face)
            transformed_components['names'].append(name)
            transformed_components['widths'].append(scaled_width)
            transformed_components['heights'].append(scaled_height)
            transformed_components['lengths'].append(scaled_length)
            
        except Exception as e:
            print(f"Error transforming beam {i}: {str(e)}")
            raise
    
    return transformed_components

def arrange_components_on_plates(transformed_components, plate_width, plate_depth, margin=10.0, spacing_factor=1.2, plate_spacing=20.0):
    # Ensure all parameters are of the correct type
    plate_width = float(plate_width)
    plate_depth = float(plate_depth)
    margin = float(margin)
    spacing_factor = float(spacing_factor)
    plate_spacing = float(plate_spacing)
    
    print(f"In arrange_components_on_plates: plate_width={plate_width}, plate_depth={plate_depth}, plate_spacing={plate_spacing}")
    
    # Create a new dictionary to store the arranged components
    arranged_components = {
        'centerlines': [],
        'frames': [],
        'blanks': [],
        'geometries': [],
        'widths': [],
        'heights': [],
        'top_faces': [],  # Add top faces to the arrangement
        'names': [],      # Add names to the arrangement
        'plate_indices': []  # Track which plate each beam is on
    }
    
    # Initialize plate layout tracking
    plates = []
    current_plate_components = {
        'centerlines': [],
        'frames': [],
        'blanks': [],
        'geometries': [],
        'widths': [],
        'heights': [],
        'top_faces': [],  # Add top faces to the plate tracking
        'names': []       # Add names to the plate tracking
    }
    
    # Start with margin on both axes
    current_x = margin
    current_y = margin
    max_width_in_column = 0  # Track the maximum width in the current column
    plate_count = 1
    plate_offset_x = 0  # Track the X offset for the current plate
    
    # Keep track of the maximum Y position used on each plate
    plate_max_y_positions = {0: margin}  # Start with the first plate (0-indexed)
    
    # Keep track of the maximum Y position for each X column on each plate
    # We'll use a dictionary of dictionaries: {plate_idx: {x_position: max_y_position}}
    # We'll discretize the X positions to a reasonable resolution
    x_resolution = margin / 2  # Half the margin as resolution
    plate_column_y_positions = {0: {}}  # Start with the first plate (0-indexed)
    
    # Get the number of beams
    num_beams = len(transformed_components['centerlines'])
    
    # Process each beam
    for i in range(num_beams):
        try:
            # Get beam components
            centerline = transformed_components['centerlines'][i]
            frame = transformed_components['frames'][i]
            blank = transformed_components['blanks'][i]
            geometry = transformed_components['geometries'][i]
            top_face = transformed_components['top_faces'][i]
            name = transformed_components['names'][i]
            width = transformed_components['widths'][i]
            height = transformed_components['heights'][i]
            length = transformed_components['lengths'][i]
            
            # Calculate spacing based on beam dimensions and spacing factor
            width_spacing = width * spacing_factor  # Spacing in X direction
            
            # Debug print to check variable types
            print(f"Beam {i}: current_x={current_x}, current_y={current_y}, length={length}, width={width}, plate_offset_x={plate_offset_x}")
            
            # Check if beam would fit in current column (Y direction)
            if current_y + length + margin > plate_depth:
                # Move to next column
                current_y = margin
                current_x += max_width_in_column + width_spacing
                max_width_in_column = 0
                
                # Check if beam would fit on current plate (X direction)
                if current_x + width + margin > plate_width:
                    # Start a new plate
                    plates.append(current_plate_components)
                    current_plate_components = {
                        'centerlines': [],
                        'frames': [],
                        'blanks': [],
                        'geometries': [],
                        'widths': [],
                        'heights': [],
                        'top_faces': [],  # Add top faces to the plate tracking
                        'names': []       # Add names to the plate tracking
                    }
                    
                    # Update plate offset for the new plate
                    plate_offset_x += plate_width + plate_spacing  # Use plate_spacing parameter
                    
                    # Reset position to the beginning of the NEW plate
                    current_x = margin
                    current_y = margin
                    max_width_in_column = 0
                    plate_count += 1
                    
                    # Initialize max Y position for the new plate
                    plate_max_y_positions[plate_count - 1] = margin
                    plate_column_y_positions[plate_count - 1] = {}
                    
                    print(f"Starting new plate {plate_count} at x-offset: {plate_offset_x}")
            
            # Calculate the absolute position (including plate offset)
            absolute_x = plate_offset_x + current_x
            
            # Calculate the position transformation for the current beam
            position_transform = Translation.from_vector([absolute_x, current_y, 0])
            
            # Apply positioning transformation to all components
            positioned_frame = frame.transformed(position_transform) if frame else None
            positioned_centerline = centerline.transformed(position_transform) if centerline else None
            positioned_blank = blank.transformed(position_transform) if blank else None
            positioned_geometry = geometry.transformed(position_transform) if geometry else None
            positioned_top_face = top_face.transformed(position_transform) if top_face else None
            
            # Add the positioned components to our lists
            arranged_components['centerlines'].append(positioned_centerline)
            arranged_components['frames'].append(positioned_frame)
            arranged_components['blanks'].append(positioned_blank)
            arranged_components['geometries'].append(positioned_geometry)
            arranged_components['top_faces'].append(positioned_top_face)
            arranged_components['names'].append(name)
            arranged_components['widths'].append(width)
            arranged_components['heights'].append(height)
            arranged_components['plate_indices'].append(plate_count - 1)  # 0-indexed plate number
            
            # Add to current plate components
            current_plate_components['centerlines'].append(positioned_centerline)
            current_plate_components['frames'].append(positioned_frame)
            current_plate_components['blanks'].append(positioned_blank)
            current_plate_components['geometries'].append(positioned_geometry)
            current_plate_components['top_faces'].append(positioned_top_face)
            current_plate_components['names'].append(name)
            current_plate_components['widths'].append(width)
            current_plate_components['heights'].append(height)
            
            # Update position for next beam - IMPORTANT: Move down in Y direction
            current_y += length + margin
            
            # Update the maximum Y position for the current plate
            plate_max_y_positions[plate_count - 1] = max(plate_max_y_positions[plate_count - 1], current_y - margin)
            
            # Update the maximum Y positions for the columns this beam occupies
            beam_start_x = current_x
            beam_end_x = current_x + width
            beam_max_y = current_y - margin
            
            # Discretize the beam's X range into columns
            col_start = int(beam_start_x / x_resolution)
            col_end = int(beam_end_x / x_resolution) + 1
            
            # Update each column's max Y position
            for col_x in range(col_start, col_end):
                x_pos = col_x * x_resolution
                if x_pos not in plate_column_y_positions[plate_count - 1]:
                    plate_column_y_positions[plate_count - 1][x_pos] = margin
                plate_column_y_positions[plate_count - 1][x_pos] = max(
                    plate_column_y_positions[plate_count - 1][x_pos], 
                    beam_max_y
                )
            
            # Update the maximum width of the current column
            max_width_in_column = max(max_width_in_column, width)
            
            print(f"Beam {i} positioned at absolute_x={absolute_x}, y={current_y-length-margin}, next y={current_y}")
            
        except Exception as e:
            print(f"Error arranging beam {i}: {str(e)}")
            raise
    
    # Add the last plate if not empty
    if current_plate_components['centerlines']:
        plates.append(current_plate_components)
    
    # Second pass: Try to place additional beams at the top of each plate, rotated by 90 degrees
    print("\nAttempting to place additional beams at the top of each plate, rotated by 90 degrees...")
    
    # Create a copy of the original transformed components to work with
    rotated_components = {
        'centerlines': [],
        'frames': [],
        'blanks': [],
        'geometries': [],
        'widths': [],
        'heights': [],
        'lengths': [],
        'top_faces': [],  # Add top faces to the rotation
        'names': []       # Add names to the rotation
    }
    
    # Create rotated versions of all beams (270 degrees around Z-axis)
    for i in range(num_beams):
        centerline = transformed_components['centerlines'][i]
        frame = transformed_components['frames'][i]
        blank = transformed_components['blanks'][i]
        geometry = transformed_components['geometries'][i]
        width = transformed_components['widths'][i]
        height = transformed_components['heights'][i]
        length = transformed_components['lengths'][i]
        top_face = transformed_components['top_faces'][i]
        name = transformed_components['names'][i]
        
        # Create rotation transformation (270 degrees around Z-axis)
        # This will rotate the beam so its length extends along the positive X-axis
        rotation = Rotation.from_axis_and_angle([0, 0, 1], math.radians(270))
        
        # Apply rotation to all components
        rotated_centerline = centerline.transformed(rotation) if centerline else None
        rotated_frame = frame.transformed(rotation) if frame else None
        rotated_blank = blank.transformed(rotation) if blank else None
        rotated_geometry = geometry.transformed(rotation) if geometry else None
        rotated_top_face = top_face.transformed(rotation) if top_face else None
        
        # Swap width and length for the rotated beam
        # After rotation, the beam's length will be along X-axis and width along Y-axis
        rotated_width = length
        rotated_length = width
        
        # Add to rotated components
        rotated_components['centerlines'].append(rotated_centerline)
        rotated_components['frames'].append(rotated_frame)
        rotated_components['blanks'].append(rotated_blank)
        rotated_components['geometries'].append(rotated_geometry)
        rotated_components['top_faces'].append(rotated_top_face)
        rotated_components['names'].append(name)
        rotated_components['widths'].append(rotated_width)
        rotated_components['heights'].append(height)
        rotated_components['lengths'].append(rotated_length)
    
    # For each plate, try to place rotated beams at the top
    for plate_idx in range(plate_count):
        # Find free regions on the plate by analyzing the column Y positions
        plate_columns = plate_column_y_positions[plate_idx]
        
        # If no columns are defined yet, use the global max Y
        if not plate_columns:
            max_y = plate_max_y_positions[plate_idx]
            print(f"Plate {plate_idx + 1}: No column data, using global max Y: {max_y}m")
            available_height = plate_depth - max_y
            
            if available_height <= margin:
                print(f"Plate {plate_idx + 1}: No space available at the top for rotated beams")
                continue
            
            # Create a single free region spanning the whole plate width
            free_regions = [(margin, max_y + margin, plate_width - 2*margin, plate_depth - max_y - 2*margin)]
        else:
            # Find continuous regions with similar Y heights
            # Group columns by their max Y position (rounded to nearest margin)
            y_groups = {}
            for x_pos, y_pos in plate_columns.items():
                y_group = round(y_pos / margin) * margin
                if y_group not in y_groups:
                    y_groups[y_group] = []
                y_groups[y_group].append(x_pos)
            
            # Sort the X positions within each Y group
            for y_group in y_groups:
                y_groups[y_group].sort()
            
            # Find continuous regions
            free_regions = []
            for y_group, x_positions in y_groups.items():
                # Skip if there's not enough height for a beam
                available_height = plate_depth - y_group - margin
                if available_height <= margin:
                    continue
                
                # Find continuous X ranges
                if not x_positions:
                    continue
                    
                start_x = x_positions[0]
                prev_x = start_x
                
                for i in range(1, len(x_positions)):
                    curr_x = x_positions[i]
                    # If there's a gap larger than resolution, create a region
                    if curr_x - prev_x > x_resolution * 1.5:
                        region_width = prev_x - start_x + x_resolution
                        if region_width >= margin:  # Only consider regions wide enough
                            free_regions.append((
                                start_x,  # x position
                                y_group + margin,  # y position (add margin for spacing)
                                region_width,  # width
                                available_height - margin  # height (subtract margin for spacing)
                            ))
                        start_x = curr_x
                    prev_x = curr_x
                
                # Add the last region
                region_width = prev_x - start_x + x_resolution
                if region_width >= margin:  # Only consider regions wide enough
                    free_regions.append((
                        start_x,  # x position
                        y_group + margin,  # y position (add margin for spacing)
                        region_width,  # width
                        available_height - margin  # height (subtract margin for spacing)
                    ))
            
            # If no regions were found using the column approach, fall back to the global max Y
            if not free_regions:
                max_y = plate_max_y_positions[plate_idx]
                available_height = plate_depth - max_y
                
                if available_height <= margin:
                    print(f"Plate {plate_idx + 1}: No space available at the top for rotated beams")
                    continue
                
                # Create a single free region spanning the whole plate width
                free_regions.append((margin, max_y + margin, plate_width - 2*margin, available_height - margin))
        
        # Calculate the plate's X offset
        plate_offset_x = plate_idx * (plate_width + plate_spacing)
        
        # Sort beams by length (which becomes width after rotation) to optimize placement
        sorted_indices = sorted(range(num_beams), key=lambda i: rotated_components['widths'][i])
        
        # Process each free region
        for region in free_regions:
            region_x, region_y, region_width, region_height = region
            
            print(f"Plate {plate_idx + 1}: Processing free region at x={region_x}m, y={region_y}m, width={region_width}m, height={region_height}m")
            
            # Skip regions that are too small
            if region_width < margin or region_height < margin:
                continue
            
            # Track the current position for placing beams
            current_row_y = region_y
            max_row_height = 0
            
            # Continue placing beams in rows until we run out of vertical space
            while current_row_y + max_row_height + margin <= region_y + region_height:
                # Start a new row at the region's left edge
                current_x = region_x
                max_row_height = 0
                
                # Flag to track if we placed any beams in this row
                beams_placed_in_row = False
                
                # Try to place each rotated beam in the current row
                for idx in sorted_indices:
                    rotated_width = rotated_components['widths'][idx]
                    rotated_length = rotated_components['lengths'][idx]
                    rotated_height = rotated_components['heights'][idx]
                    
                    # Skip beams that have already been placed (by setting their width to -1)
                    if rotated_width < 0:
                        continue
                    
                    # Check if the rotated beam would fit in the current row (X direction)
                    if current_x + rotated_width + margin > region_x + region_width:
                        # No more space in this row for this beam, try the next one
                        continue
                    
                    # Get the rotated components
                    rotated_centerline = rotated_components['centerlines'][idx]
                    rotated_frame = rotated_components['frames'][idx]
                    rotated_blank = rotated_components['blanks'][idx]
                    rotated_geometry = rotated_components['geometries'][idx]
                    rotated_top_face = rotated_components['top_faces'][idx]
                    name = rotated_components['names'][idx]
                    
                    # Calculate the absolute position (including plate offset)
                    absolute_x = plate_offset_x + current_x
                    
                    # Calculate the position transformation for the rotated beam
                    position_transform = Translation.from_vector([absolute_x, current_row_y, 0])
                    
                    # Apply positioning transformation to all components
                    positioned_frame = rotated_frame.transformed(position_transform) if rotated_frame else None
                    positioned_centerline = rotated_centerline.transformed(position_transform) if rotated_centerline else None
                    positioned_blank = rotated_blank.transformed(position_transform) if rotated_blank else None
                    positioned_geometry = rotated_geometry.transformed(position_transform) if rotated_geometry else None
                    positioned_top_face = rotated_top_face.transformed(position_transform) if rotated_top_face else None
                    
                    # Add the positioned components to our lists
                    arranged_components['centerlines'].append(positioned_centerline)
                    arranged_components['frames'].append(positioned_frame)
                    arranged_components['blanks'].append(positioned_blank)
                    arranged_components['geometries'].append(positioned_geometry)
                    arranged_components['top_faces'].append(positioned_top_face)
                    arranged_components['names'].append(name)
                    arranged_components['widths'].append(rotated_width)
                    arranged_components['heights'].append(rotated_height)
                    arranged_components['plate_indices'].append(plate_idx)
                    
                    # Add to current plate components
                    plates[plate_idx]['centerlines'].append(positioned_centerline)
                    plates[plate_idx]['frames'].append(positioned_frame)
                    plates[plate_idx]['blanks'].append(positioned_blank)
                    plates[plate_idx]['geometries'].append(positioned_geometry)
                    plates[plate_idx]['top_faces'].append(positioned_top_face)
                    plates[plate_idx]['names'].append(name)
                    plates[plate_idx]['widths'].append(rotated_width)
                    plates[plate_idx]['heights'].append(rotated_height)
                    
                    # Update position for next beam - IMPORTANT: Move right in X direction
                    current_x += rotated_width + margin  # Just use margin in X direction for rotated beams
                    
                    # Update the maximum height in this row
                    max_row_height = max(max_row_height, rotated_length)
                    
                    # Mark this beam as placed by setting its width to -1
                    rotated_components['widths'][idx] = -1
                    
                    beams_placed_in_row = True
                    
                    print(f"Rotated beam {idx} positioned at absolute_x={absolute_x}, y={current_row_y}, width={rotated_width}, length={rotated_length}")
                
                # If we couldn't place any beams in this row, break the loop
                if not beams_placed_in_row:
                    break
                
                # Move to the next row - IMPORTANT: Use margin for Y direction with rotated beams
                current_row_y += margin + max_row_height -0.006
                
                # Check if we have any beams left to place
                if all(width < 0 for width in rotated_components['widths']):
                    break
            
    # Return the arranged components and number of plates used
    return arranged_components, plate_count, plates

def create_plate_rectangles(plate_width, plate_depth, plate_count, plate_spacing=20.0):
    plate_rectangles = []
    
    # Ensure parameters are of the correct type
    plate_width = float(plate_width)
    plate_depth = float(plate_depth)
    plate_spacing = float(plate_spacing)
    
    print(f"Creating {plate_count} plate rectangles with width={plate_width}m, depth={plate_depth}m, spacing={plate_spacing}m")
    
    plate_offset_x = 0  # Track the X offset for the current plate
    
    for i in range(plate_count):
        # Create a rectangle for each plate, positioned along the x-axis
        # Use the same spacing logic as in arrange_components_on_plates
        x_offset = plate_offset_x
        
        # Create rectangle corners
        p1 = rg.Point3d(x_offset, 0, 0)
        p2 = rg.Point3d(x_offset + plate_width, 0, 0)
        p3 = rg.Point3d(x_offset + plate_width, plate_depth, 0)
        p4 = rg.Point3d(x_offset, plate_depth, 0)
        
        # Create rectangle
        rectangle = rg.Polyline()
        rectangle.Add(p1)
        rectangle.Add(p2)
        rectangle.Add(p3)
        rectangle.Add(p4)
        rectangle.Add(p1)  # Close the rectangle
        
        plate_rectangles.append(rectangle)
        
        print(f"Plate {i+1} created at x={x_offset}m with width={plate_width}m and depth={plate_depth}m")
        
        # Update plate offset for the next plate
        plate_offset_x += plate_width + plate_spacing
    
    return plate_rectangles

def prepare_beams_for_3d_printing(beams, plate_width=200, plate_depth=200, margin=10, scale_ratio=20, spacing_factor=1.2, plate_spacing=20):
    # Debug print to check input parameters
    print(f"prepare_beams_for_3d_printing: plate_width={plate_width}, plate_depth={plate_depth}, margin={margin}, scale_ratio={scale_ratio}, spacing_factor={spacing_factor}, plate_spacing={plate_spacing}")
    
    # Convert mm to m for all dimensions
    plate_width_m = float(plate_width) / 1000.0
    plate_depth_m = float(plate_depth) / 1000.0
    margin_m = float(margin) / 1000.0
    plate_spacing_m = float(plate_spacing) / 1000.0
    
    # Ensure scale_ratio and spacing_factor are floats
    scale_ratio = float(scale_ratio)
    spacing_factor = float(spacing_factor)
    
    # Step 1: Decompose beams to get their components
    beam_components = decompose_beams(beams)
    
    # Step 2: Transform and scale beam components
    transformed_components = transform_beam_components(beam_components, scale_ratio)
    
    # Step 3: Arrange components on plates
    # Use margin_m as the spacing between beams on the same plate
    arranged_components, plate_count, plates = arrange_components_on_plates(
        transformed_components, 
        plate_width_m, 
        plate_depth_m, 
        margin_m, 
        spacing_factor, 
        plate_spacing_m
    )
    
    # Step 4: Create plate rectangles for visualization (arranged in X direction)
    # Use plate_spacing_m as the spacing between plates
    plate_rectangles = create_plate_rectangles(plate_width_m, plate_depth_m, plate_count, plate_spacing_m)
    
    print(f"Successfully arranged {len(beams)} beams on {plate_count} plates")
    
    return arranged_components, plate_count, plate_rectangles, plates

def calculate_time_cost():
    # Initialize total volume as a number, not a list
    total_volume = 0.0

    # Calculate total volume by summing up all geometry volumes
    for geometry in arranged_components['geometries']:
        if geometry is not None:
            total_volume += geometry.volume

    # Print the total volume for debugging
    print(f"Total volume: {total_volume} m³")

    # time per mm3 = 0.00089 min / mm3
    time_per_mm3 = 0.00715  # minutes per mm³

    # Convert time factor from minutes/mm³ to minutes/m³
    time_per_m3 = time_per_mm3 * 1_000_000_000  # 0.00715 min/mm³ * 1,000,000,000 = 7,150,000 min/m³

    # cost per hour = 1 CHF
    cost_per_hour = 1.0  # CHF per hour

    # Calculate total time in minutes
    total_time_minutes = total_volume * time_per_m3
    
    # Convert to hours
    total_time_hours = total_time_minutes / 60.0

    # Calculate total cost
    total_cost = total_time_hours * cost_per_hour
    
    # Create a formatted string with all the calculations
    calculations = f"""
    3D PRINTING CALCULATIONS
    ------------------------
    Total volume: {total_volume:.6f} m³ ({total_volume * 1_000_000_000:.2f} mm³)
    Print time factor: {time_per_mm3:.6f} min/mm³
    Total print time: {total_time_hours:.2f} hours ({total_time_minutes:.2f} minutes)
    Cost per hour: {cost_per_hour:.2f} CHF
    Total cost: {total_cost:.2f} CHF
    ------------------------
    """
    
    return total_time_hours, total_cost, calculations
    

# ========================================
# Execution
# ========================================

# Ensure variables are properly defined
beams = beams

# Define parameters with default values if not already set
plate_width = plate_width
plate_depth = plate_depth if 'plate_depth' in locals() else 200  # mm
margin = margin if 'margin' in locals() else 10  # mm
scale_ratio = scale_ratio if 'scale_ratio' in locals() else 20
spacing_factor = spacing_factor if 'spacing_factor' in locals() else 1.2
plate_spacing = plate_spacing if 'plate_spacing' in locals() else 20  # mm

# Always convert plate dimensions from mm to m for display purposes
plate_width_m = float(plate_width) / 1000.0
plate_depth_m = float(plate_depth) / 1000.0
margin_m = float(margin) / 1000.0
plate_spacing_m = float(plate_spacing) / 1000.0

print(f"Input parameters: plate_width={plate_width_m}m, plate_depth={plate_depth_m}m, margin={margin_m}m, scale_ratio={scale_ratio}, spacing_factor={spacing_factor}, plate_spacing={plate_spacing_m}m")

# try:
arranged_components, plate_count, plate_rectangles, plates = prepare_beams_for_3d_printing(
    beams, 
    plate_width, 
    plate_depth, 
    margin, 
    scale_ratio, 
    spacing_factor,
    plate_spacing
)

print(f"Beams arranged on {plate_count} plates")

# Output the plate rectangles for visualization
plate_visualization = plate_rectangles

# Output the transformed geometries for visualization
beam_geometries = arranged_components['geometries']

# Output the top faces for visualization
beam_top_faces = arranged_components['top_faces']

beam_names = arranged_components['names']

# Calculate time and cost 
# formatted output
total_time, total_cost, calculations = calculate_time_cost()
print(f"Total time: {total_time} hours")
print(f"Total cost: {total_cost} CHF")
print(calculations)
# ---------- end _3d_print_pipeline ----------
draw_2 = COMPASDraw(cg=_3d_print_pipeline.beam_geometries)  # -> rg; same code as draw
crv = Curve(_3d_print_pipeline.plate_rectangles)
panel_7 = Panel(_3d_print_pipeline.calculations)

# ---- group: Carbon Emissions
# Statistics, Analysis
spruce_kg_co₂e_m³ = Panel("90")
# Additional Task
carbon_emissions = Python3Script(beams=dam_3, co2_factor=spruce_kg_co₂e_m³)  # -> carbon_emissions; inputs beams: list, co2_factor: Double
# ---------- carbon_emissions: Python ----------
# ADDITIONAL TASK: METRICS / CARBON EMISSIONS

# Calculate the total carbon emissions of your structure

# you can use the factor 90kg CO₂e/m³ as a reference

carbon_emissions = "to be done by you"
# ---------- end carbon_emissions ----------
panel_8 = Panel(carbon_emissions)

# ---- group: Generate 3D Beam Numbering
dam_4 = DataDam(DataA=_3d_print_pipeline.beam_names, BufferDelay=10000000, BufferMode=0)
_3d_typeface = Python3Script(text=dam_4, scale=Slider(2.65, range=0..10), spacing=Slider(10, range=0..100))  # -> out, simplify(a); inputs text: String, extrusion_height: Double, scale: Double, spacing: Double
# ---------- _3d_typeface: Python ----------
"""
COMPAS Typeface Generator for Grasshopper
-----------------------------------------
This script uses a vector instruction library (JSON) to create
COMPAS geometric objects from text input within Grasshopper.

Inputs:
    library_path: Path to JSON file with vector instructions (string)
    text: Text to convert to geometry (string)
    extrusion_height: Height for extruding the text (float, optional)
    scale: Scale factor for the geometry (float, optional)
    spacing: Spacing between characters (float, optional)

Outputs:
    polylines: COMPAS polylines representing the text
"""

import os
import sys
import json
import numpy as np
from pathlib import Path

# COMPAS imports
import compas
from compas.geometry import Point, Vector, Line, Polyline, Brep
from compas.datastructures import Mesh

# Rhino imports
import rhinoscriptsyntax as rs
import Rhino.Geometry as rg
import ghpythonlib.components as ghcomp
import scriptcontext as sc

# ---------------------- Class ---------------------

class CompasTypeface:
    def __init__(self, library_path):
        self.library = {}
        self.library_path = library_path
        
        self.load_library(library_path)
    
    def load_library(self, library_path):
        with open(library_path, 'r') as f:
            self.library = json.load(f)
        # print(f"Loaded vector library from {library_path}")
    
    def get_char_vectors(self, char):
        if char in self.library:
            # Convert the JSON format back to the expected format
            commands = []
            for cmd_data in self.library[char]:
                cmd = cmd_data[0]
                points = cmd_data[1]
                
                if cmd == 'moveTo' or cmd == 'lineTo':
                    commands.append((cmd, tuple(points)))
                elif cmd == 'curveTo':
                    # Cubic Bezier has 3 points (2 control + end)
                    commands.append((cmd, tuple(tuple(p) for p in points)))
                elif cmd == 'qCurveTo':
                    # Quadratic Bezier has 2 points (1 control + end)
                    if points and isinstance(points[0], list):
                        commands.append((cmd, tuple(tuple(p) for p in points)))
                    else:
                        # Handle case where points might not be nested correctly
                        commands.append((cmd, ((points[0], points[1]),)))
                elif cmd == 'closePath':
                    commands.append((cmd, None))
            
            return commands
        
        print(f"Character '{char}' not found in the library")
        return None
    
    def get_char_width(self, char, commands=None):
        if commands is None:
            commands = self.get_char_vectors(char)
            if not commands:
                return 500  # Default width if character not found
        
        # Find the rightmost x-coordinate in the character's commands
        max_x = 0
        for cmd, points in commands:
            if cmd in ['moveTo', 'lineTo']:
                x, y = points
                max_x = max(max_x, x)
            elif cmd in ['curveTo', 'qCurveTo']:
                for point in points:
                    x, y = point
                    max_x = max(max_x, x)
        
        # Add some padding to ensure characters don't overlap
        return max_x + 100  # Add padding
    
    def path_to_compas_polylines(self, path_commands, scale=1.0, position=(0, 0, 0)):
        polylines = []
        current_polyline = []
        
        for cmd, points in path_commands:
            if cmd == 'moveTo':
                if current_polyline:
                    # Add the previous polyline if it has points
                    if len(current_polyline) > 1:
                        polylines.append(Polyline(current_polyline))
                
                # Start a new polyline
                x, y = points
                point = Point(x * scale + position[0], 
                             y * scale + position[1], 
                             position[2])
                current_polyline = [point]
            
            elif cmd == 'lineTo':
                x, y = points
                point = Point(x * scale + position[0], 
                             y * scale + position[1], 
                             position[2])
                current_polyline.append(point)
            
            elif cmd == 'curveTo':
                # For cubic Bezier curves, we'll approximate with multiple line segments
                start_point = current_polyline[-1]
                control_points = [Point(p[0] * scale + position[0], 
                                       p[1] * scale + position[1], 
                                       position[2]) for p in points]
                
                # Create a Bezier curve and sample points along it
                control_points.insert(0, start_point)
                
                # In COMPAS 2.9.1, we need to manually evaluate the Bezier curve
                # Sample 10 points along the curve (adjust as needed for smoothness)
                for t in np.linspace(0.1, 1.0, 10):
                    # Cubic Bezier formula: B(t) = (1-t)^3 * P0 + 3(1-t)^2 * t * P1 + 3(1-t) * t^2 * P2 + t^3 * P3
                    p0, p1, p2, p3 = control_points
                    
                    # Calculate the Bezier point manually
                    mt = 1 - t
                    mt2 = mt * mt
                    mt3 = mt2 * mt
                    t2 = t * t
                    t3 = t2 * t
                    
                    x = mt3 * p0.x + 3 * mt2 * t * p1.x + 3 * mt * t2 * p2.x + t3 * p3.x
                    y = mt3 * p0.y + 3 * mt2 * t * p1.y + 3 * mt * t2 * p2.y + t3 * p3.y
                    z = mt3 * p0.z + 3 * mt2 * t * p1.z + 3 * mt * t2 * p2.z + t3 * p3.z
                    
                    point = Point(x, y, z)
                    current_polyline.append(point)
            
            elif cmd == 'qCurveTo':
                # For quadratic Bezier curves
                start_point = current_polyline[-1]
                control_points = [Point(p[0] * scale + position[0], 
                                       p[1] * scale + position[1], 
                                       position[2]) for p in points]
                
                # Check if we have enough control points
                if len(control_points) < 1:
                    continue  # Skip if not enough points
                
                # In a quadratic Bezier, we need the start point, one control point, and an end point
                p0 = start_point
                
                # If there's only one point in points, it's the end point (implicit control)
                # If there are two, first is control point, second is end point
                if len(control_points) == 1:
                    # When only the end point is given, we can interpolate the control point
                    p2 = control_points[0]  # End point
                    # Interpolate control point midway between start and end
                    p1 = Point((p0.x + p2.x) / 2, (p0.y + p2.y) / 2, (p0.z + p2.z) / 2)
                else:
                    p1 = control_points[0]  # Control point
                    p2 = control_points[-1]  # End point
                
                # Sample 10 points along the curve
                for t in np.linspace(0.1, 1.0, 10):
                    # Quadratic Bezier formula: B(t) = (1-t)^2 * P0 + 2(1-t) * t * P1 + t^2 * P2
                    mt = 1 - t
                    mt2 = mt * mt
                    t2 = t * t
                    
                    x = mt2 * p0.x + 2 * mt * t * p1.x + t2 * p2.x
                    y = mt2 * p0.y + 2 * mt * t * p1.y + t2 * p2.y
                    z = mt2 * p0.z + 2 * mt * t * p1.z + t2 * p2.z
                    
                    point = Point(x, y, z)
                    current_polyline.append(point)
            
            elif cmd == 'closePath':
                # Close the current polyline if it has points
                if len(current_polyline) > 1:
                    # Add the first point again to close the loop
                    current_polyline.append(current_polyline[0])
                    polylines.append(Polyline(current_polyline))
                    current_polyline = []
        
        # Add any remaining polyline
        if len(current_polyline) > 1:
            polylines.append(Polyline(current_polyline))
        
        return polylines
    
    def char_to_compas_polylines(self, char, scale=1.0, position=(0, 0, 0)):
        path_commands = self.get_char_vectors(char)
        if path_commands:
            return self.path_to_compas_polylines(path_commands, scale, position)
        return []
    
    def text_to_compas_polylines(self, text, scale=1.0, spacing=1.0, position=(0, 0, 0)):
        all_polylines = []
        x_offset = 0
        
        for char in text:
            if char == ' ':
                # Handle space character
                x_offset += 500 * spacing * scale
                continue
            
            # Get character commands
            char_commands = self.get_char_vectors(char)
            if not char_commands:
                continue
                
            # Get character width for proper spacing
            char_width = self.get_char_width(char, char_commands)
            
            # Position for this character
            char_position = (position[0] + x_offset, position[1], position[2])
            
            # Get polylines for this character
            char_polylines = self.path_to_compas_polylines(char_commands, scale, char_position)
            all_polylines.extend(char_polylines)
            
            # Update x_offset for next character with proper spacing
            x_offset += char_width * spacing * scale
        
        return all_polylines

# ---------------------- Functions ---------------------

def compas_polyline_to_rhino(polyline):
    points = [rg.Point3d(p.x, p.y, p.z) for p in polyline.points]
    return rg.Polyline(points)

# Main Grasshopper script function
def create_compas_text(library_path, text, extrusion_height=0.0, scale=0.01, spacing=1.0):
    # Initialize the COMPAS typeface generator
    compas_typeface = CompasTypeface(library_path)
    
    # Create polylines from text
    compas_polylines = compas_typeface.text_to_compas_polylines(
        text, scale=scale, spacing=spacing
    )
    
    # Convert COMPAS polylines to Rhino polylines
    rhino_polylines = [compas_polyline_to_rhino(pl) for pl in compas_polylines]
    
    # Create extrusions if requested
    compas_breps = []
    # if extrusion_height > 0:
    #     compas_breps = compas_typeface.create_extruded_brep(
    #         compas_polylines, height=extrusion_height
    #     )
    
    return rhino_polylines, compas_breps


# ====================================================
# Execution
# ====================================================

import scriptcontext
filepath = scriptcontext.doc.Component.OnPingDocument().FilePath
library_path =  os.path.join(os.path.dirname(filepath), "_resources", "arial_vector_library.json")
_library_path = library_path  # Path to the JSON library file

# Inputs
_text = text  # Text to convert
_extrusion_height = extrusion_height / 10000 if extrusion_height is not None else 0.0
_scale = scale / 10000 if scale is not None else 0.01
_spacing = spacing / 10 if spacing is not None else 1.0

# Process
polylines, breps = create_compas_text(_library_path, _text, _extrusion_height, _scale, _spacing)

# Outputs
a = polylines  # Rhino polylines
# ---------- end _3d_typeface ----------

# ---- group: FEA - Structural Analysis
# Data to Karamba3D
out = DataOutput(
    BaseSurface=target_srf,
    Destination="/Users/wasserwerk84/Library/CloudStorage/GoogleDrive-lorinw@ethz.ch/Geteilte Ablagen/GKR_Teaching/Coding_Architecture/CAII/ADMIN/06_Course-Material/08_Structural-Integrity/01_Karamba3d/00_Dynamic-Line-Model/surface.ghdata",
    RelativePath="/Users/wasserwerk84/Library/CloudStorage/GoogleDrive-lorinw@ethz.ch/Geteilte Ablagen/GKR_Teaching/Coding_Architecture/CAII/ADMIN/06_Course-Material/08_Structural-Integrity/01_Karamba3d/00_Dynamic-Line-Model/surface.ghdata|../../../../../08_Structural-Integrity/01_Karamba3d/00_Dynamic-Line-Model/surface.ghdata")  # disabled
out_2 = DataOutput(
    DataInput=detessellation.rods,
    Destination="/Users/wasserwerk84/Library/CloudStorage/GoogleDrive-lorinw@ethz.ch/Geteilte Ablagen/GKR_Teaching/Coding_Architecture/CAII/ADMIN/06_Course-Material/08_Structural-Integrity/01_Karamba3d/00_Dynamic-Line-Model/line-model.ghdata",
    RelativePath="/Users/wasserwerk84/Library/CloudStorage/GoogleDrive-lorinw@ethz.ch/Geteilte Ablagen/GKR_Teaching/Coding_Architecture/CAII/ADMIN/06_Course-Material/08_Structural-Integrity/01_Karamba3d/00_Dynamic-Line-Model/line-model.ghdata|../../../../../08_Structural-Integrity/01_Karamba3d/00_Dynamic-Line-Model/line-model.ghdata")  # disabled
out_3 = DataOutput(
    Destination="/Users/wasserwerk84/Library/CloudStorage/GoogleDrive-lorinw@ethz.ch/Geteilte Ablagen/GKR_Teaching/Coding_Architecture/CAII/ADMIN/06_Course-Material/08_Structural-Integrity/01_Karamba3d/00_Dynamic-Line-Model/connectivity-a.ghdata",
    RelativePath="/Users/wasserwerk84/Library/CloudStorage/GoogleDrive-lorinw@ethz.ch/Geteilte Ablagen/GKR_Teaching/Coding_Architecture/CAII/ADMIN/06_Course-Material/08_Structural-Integrity/01_Karamba3d/00_Dynamic-Line-Model/connectivity-a.ghdata|../../../../../08_Structural-Integrity/01_Karamba3d/00_Dynamic-Line-Model/connectivity-a.ghdata")  # disabled
out_4 = DataOutput(
    Destination="/Users/wasserwerk84/Library/CloudStorage/GoogleDrive-lorinw@ethz.ch/Geteilte Ablagen/GKR_Teaching/Coding_Architecture/CAII/ADMIN/06_Course-Material/08_Structural-Integrity/01_Karamba3d/00_Dynamic-Line-Model/connectivity-b.ghdata",
    RelativePath="/Users/wasserwerk84/Library/CloudStorage/GoogleDrive-lorinw@ethz.ch/Geteilte Ablagen/GKR_Teaching/Coding_Architecture/CAII/ADMIN/06_Course-Material/08_Structural-Integrity/01_Karamba3d/00_Dynamic-Line-Model/connectivity-b.ghdata|../../../../../08_Structural-Integrity/01_Karamba3d/00_Dynamic-Line-Model/connectivity-b.ghdata")  # disabled

# Data from Karamba3D
in = DataInput(
    Destination="/Users/wasserwerk84/Library/CloudStorage/GoogleDrive-lorinw@ethz.ch/Geteilte Ablagen/GKR_Teaching/Coding_Architecture/CAII/ADMIN/06_Course-Material/08_Structural-Integrity/01_Karamba3d/00_Karamba-Out/Mesh-Deformed.ghdata",
    RelativePath="/Users/wasserwerk84/Library/CloudStorage/GoogleDrive-lorinw@ethz.ch/Geteilte Ablagen/GKR_Teaching/Coding_Architecture/CAII/ADMIN/06_Course-Material/08_Structural-Integrity/01_Karamba3d/00_Karamba-Out/Mesh-Deformed.ghdata|../../../../../08_Structural-Integrity/01_Karamba3d/00_Karamba-Out/Mesh-Deformed.ghdata",
    UpdateDelay=50000)  # disabled
in_2 = DataInput(
    Destination="/Users/wasserwerk84/Library/CloudStorage/GoogleDrive-lorinw@ethz.ch/Geteilte Ablagen/GKR_Teaching/Coding_Architecture/CAII/ADMIN/06_Course-Material/08_Structural-Integrity/01_Karamba3d/00_Karamba-Out/Analysis-Results.ghdata",
    RelativePath="/Users/wasserwerk84/Library/CloudStorage/GoogleDrive-lorinw@ethz.ch/Geteilte Ablagen/GKR_Teaching/Coding_Architecture/CAII/ADMIN/06_Course-Material/08_Structural-Integrity/01_Karamba3d/00_Karamba-Out/Analysis-Results.ghdata|../../../../../08_Structural-Integrity/01_Karamba3d/00_Karamba-Out/Analysis-Results.ghdata",
    UpdateDelay=50000)  # disabled

# Results
panel_9 = Panel(in_2)  # disabled
deformed_mesh = Mesh(in)  # disabled

# ----
draw_3 = COMPASDraw(cg=beam_analysis.stock_beams)  # -> rg; same code as draw
draw_4 = COMPASDraw(cg=beam_analysis.packed_beams)  # -> rg; same code as draw
preview_3 = CustomPreview(Geometry=draw_3, Material=ColourSwatch(SwatchColor=RGB(163, 140, 119)))
preview_4 = CustomPreview(Geometry=draw_4, Material=ColourSwatch(SwatchColor=RGB(146, 176, 134)))

# ----
# Visualize
pt_2 = Point(pt)
tag = TextTag3D(
    Location=pt_2,
    Text=beam_analysis.beam_stats,
    Size=Slider(0.2, range=0..1),
    Colour=ColourSwatch(SwatchColor=RGB(87, 87, 87)),
    Justification=8)

# ---- group: Beam Names
debeams_2 = Python3Script(beams=beams)  # -> top_faces, names, flags; inputs beams: list
# ---------- debeams_2: Python ----------
import Rhino.Geometry as rg
from compas.geometry import Line, Frame
from compas_rhino.conversions import line_to_rhino, frame_to_rhino, brep_to_rhino, box_to_rhino
from compas.scene import Scene

def decompose_and_convert_beams(beams):
    """
    Decomposes beams into structured outputs and converts all geometry to Rhino format.

    - Converts centerlines to Rhino `Curve`
    - Converts frames to Rhino `Plane`
    - Converts blanks to Rhino `Brep`
    - Converts full geometry to Rhino `Brep`
    - Extracts names (IDs)
    - Extracts flags

    Parameters:
    - beams (list): List of beam objects.

    Returns:
    - list of rg.Curve: Centerlines as Rhino curves.
    - list of rg.Plane: Frames as Rhino planes.
    - list of rg.Brep: Blanks as Rhino breps (if available).
    - list of rg.Brep: Full beam geometries as Rhino breps.
    - list of str: Beam IDs.
    - list of str: Flags as text.
    """

    centerlines = []
    frames = []
    blanks = []
    geometries = []
    names = []
    flags_list = []
    top_faces = []

    for beam in beams:
        # Convert centerline to Rhino Curve
        centerline_rhino = None
        if hasattr(beam, "centerline"):
            centerline_rhino = line_to_rhino(Line(beam.centerline.start, beam.centerline.end))
        centerlines.append(centerline_rhino)

        # Convert frame to Rhino Plane
        frame_rhino = None
        if hasattr(beam, "frame"):
            frame_rhino = frame_to_rhino(Frame(beam.frame.point, beam.frame.xaxis, beam.frame.yaxis))
        frames.append(frame_rhino)

        # Convert blank to Rhino Brep
        blank_rhino = None
        if getattr(beam, "blank", None):
            blank_rhino = box_to_rhino(beam.blank)
        blanks.append(blank_rhino)

        # Convert full beam geometry to Rhino Brep
        geom_rhino = None
        geom_compas = None
        if hasattr(beam, "geometry"):
            geom_rhino = brep_to_rhino(beam.geometry)
            geom_comaps = beam.geometry
        geometries.append(geom_rhino)

        # Extract name from assembly_name
        assembly_name = getattr(beam, "assembly_name", f"Beam_{beams.index(beam)}")
        names.append(assembly_name)

        top_face = beam.faces[3]
        top_faces.append(top_face)


        # Extract flags as readable text
        flag_texts = []
        if getattr(beam, "do_not_produce", False):
            flag_texts.append("DO NOT PRODUCE")
        if getattr(beam, "to_be_discarded", False):
            flag_texts.append("TO BE DISCARDED")
        
        flags_list.append(", ".join(flag_texts) if flag_texts else "OK")

    return centerlines, frames, blanks, geometries, names, flags_list, top_faces


# ------------------------------------------------------------------
# Execution
# ------------------------------------------------------------------



# Convert beams to Rhino-compatible geometry
centerlines, frames, blanks, geometries, names, flags, top_faces = decompose_and_convert_beams(beams)
# ---------- end debeams_2 ----------
pln = Pln(cg=debeams_2.top_faces)
tag_2 = TextTag3D(
    Location=pln,
    Text=debeams_2.names,
    Size=Slider(0.05, range=0..1),
    Colour=ColourSwatch(SwatchColor=RGB(0, 0, 0)),
    Justification=5)

# ---- group: 3D Print Estimate
L = L(L=_3d_print_pipeline.plate_rectangles)
data_3 = Data(_3d_print_pipeline.calculations)
tag_3 = TextTag3D(
    Location=L,
    Text=data_3,
    Size=Slider(0.006, range=0..0.01),
    Colour=ColourSwatch(SwatchColor=RGB(0, 0, 0)),
    Justification=5)

# ---- group: Beam Names 3D Print
pln_2 = Pln(cg=_3d_print_pipeline.beam_top_faces)
tag_4 = TextTag3D(
    Location=pln_2,
    Text=_3d_print_pipeline.beam_names,
    Size=Slider(0.005, range=0..0.01),
    Colour=ColourSwatch(SwatchColor=RGB(0, 0, 0)),
    Justification=5)

# ---- group: Generate 3D Beam Numbering
# If you wish you can use this setup to 3D print your structure. We recommend not to use a scale smaller than 1:15.
# 
# You will have to bake the scaled beams as well as the 3D text and perform a Boolean subtraction in Rhino. Without the numbering the assembly is very difficult.
# 
# This is NOT mandatory.
_3d_numbering = _3DNumbering(data=pln_2, E=_3d_typeface.a)  # -> G, G_2
# You don't have to interact with this section. If you want you can use this to create your own FEA simulation, however.
_3d_text = Data(_3d_numbering.G_2)
_2d_text = Data(_3d_numbering.G)

# ==== cluster Colourful: Display objects in bright colours
geo = ClusterInput()
geo_2 = Geometry(geo)
clean = CleanTree(RemoveNulls=True, RemoveInvalid=True, RemoveEmpty=False, Tree=flatten(geo_2))
S = Shader([{diffuse=RGB(11, 125, 222), emission=RGB(3, 38, 67), shine=0.5, specular=RGB(255, 255, 255), transparency=0}, {diffuse=RGB(222, 37, 11), emission=RGB(67, 11, 3), shine=0.5, specular=RGB(255, 255, 255), transparency=0}, {diffuse=RGB(71, 222, 11), emission=RGB(21, 67, 3), shine=0.5, specular=RGB(255, 255, 255), transparency=0}, {diffuse=RGB(222, 194, 11), emission=RGB(67, 58, 3), shine=0.5, specular=RGB(255, 255, 255), transparency=0}])
lng = ListLength(List=clean)
repeat = RepeatData(Data=S, Length=lng)
preview = CustomPreview(Geometry=clean, Shader=repeat)

# ==== cluster Goals
connectivity_a = ClusterInput()
connectivity_b = ClusterInput()
relay = ClusterInput()
line = ClusterInput()
connectivity_a_2 = Data(connectivity_a)
connectivity_b_2 = Data(connectivity_b)

# ---- group: Projected Lines
line_2 = Line(flatten(line))

# ----
number_slider = Slider(0.015, range=0..0.05)
# Kangaroo.dll Location
# 
# Win:
# C:\Program Files\Rhino\Plug-ins\Grasshopper\Components\KangarooSolver.dll
# 
# MacOS:
# /Applications/Rhino 8.app/Contents/Frameworks/RhCore.framework/Versions/A/Resources/ManagedPlugIns/GrasshopperPlugin.rhp/Components/KangarooSolver.dll
number_slider_2 = Slider(0.14, range=0..1)
length_line = LengthLine(Line=line_2, Strength=10)
item = ListItem(List=line_2, Index=connectivity_a_2, Wrap=True)
item_2 = ListItem(List=line_2, Index=connectivity_b_2, Wrap=True)
end = EndPoints(Curve=line_2)  # -> Start, End
lineline = CSharpScript(L1=item, L2=item_2, R1=number_slider, R2=number_slider, Strength=number_slider_2)  # -> out, a; inputs L1: Line, L2: Line, R1: Double, R2: Double, Strength: Double
# ---------- lineline: C# ----------
// Grasshopper Script Instance
#region Usings
using System;
#r "/Applications/Rhino 8.app/Contents/Frameworks/RhCore.framework/Versions/A/Resources/ManagedPlugIns/GrasshopperPlugin.rhp/Components/KangarooSolver.dll"
using System.Linq;
using System.Collections;
using System.Collections.Generic;
using System.Drawing;

using Rhino;
using Rhino.Geometry;

using Grasshopper;
using Grasshopper.Kernel;
using Grasshopper.Kernel.Data;
using Grasshopper.Kernel.Types;

using KangarooSolver;
using KangarooSolver.Goals;
#endregion

public class Script_Instance : GH_ScriptInstance
{
    #region Notes
    /* 
      Members:
        RhinoDoc RhinoDocument
        GH_Document GrasshopperDocument
        IGH_Component Component
        int Iteration

      Methods (Virtual & overridable):
        Print(string text)
        Print(string format, params object[] args)
        Reflect(object obj)
        Reflect(object obj, string method_name)
    */
    #endregion

    private void RunScript(
		Line L1,
		Line L2,
		double R1,
		double R2,
		double Strength,
		ref object a)
    {
                
        a = new LineLine(L1, L2, R1, R2, Strength);
    }

    public class LineLine : GoalObject
    {
        public double Strength;
        public double R1,R2;

        public LineLine(Line L1, Line L2, double r1, double r2, double k)
        {
        Strength = k;

        PPos = new Point3d[4]{L1.From, L1.To, L2.From, L2.To};
        Move = new Vector3d[4];
        Weighting = new double[4]{k,k,k,k};

        R1 = r1;
        R2 = r2;
        }

        public override void Calculate(List < KangarooSolver.Particle > p)
        {
        var L1 = new Line(p[PIndex[0]].Position, p[PIndex[1]].Position);
        var L2 = new Line(p[PIndex[2]].Position, p[PIndex[3]].Position);

        Vector3d u = L1.To - L1.From;
        Vector3d v = L2.To - L2.From;
        Vector3d w = L1.From - L2.From;
        double a = u * u;
        double b = u * v;
        double c = v * v;
        double d = u * w;
        double e = v * w;
        double D = a * c - b * b;
        double sc, sN, sD = D;
        double tc, tN, tD = D;

        // compute the line parameters of the two closest points
        if (D < 1e-8) {     // the lines are almost parallel
            sN = 0.0;         // force using point P0 on segment S1
            sD = 1.0;         // to prevent possible division by 0.0 later
            tN = e;
            tD = c;
        }
        else
        {
            sN = b * e - c * d;
            tN = a * e - b * d;

            if (sN < 0.0) {        // sc < 0 => the s=0 edge is visible
            sN = 0.0;
            tN = e;
            tD = c;
            }
            else if (sN > sD) {  // sc > 1  => the s=1 edge is visible
            sN = sD;
            tN = e + b;
            tD = c;
            }
        }

        if (tN < 0.0)
        {            // tc < 0 => the t=0 edge is visible
            tN = 0.0;
            // recompute sc for this edge
            if (-d < 0.0)
            sN = 0.0;
            else if (-d > a)
            sN = sD;
            else {
            sN = -d;
            sD = a;
            }
        }
        else if (tN > tD)
        {      // tc > 1  => the t=1 edge is visible
            tN = tD;
            // recompute sc for this edge
            if ((-d + b) < 0.0)
            sN = 0;
            else if ((-d + b) > a)
            sN = sD;
            else {
            sN = (-d + b);
            sD = a;
            }
        }

        // finally do the division to get sc and tc
        sc = (Math.Abs(sN) < 1e-8 ? 0.0 : sN / sD);
        tc = (Math.Abs(tN) < 1e-8 ? 0.0 : tN / tD);

        // get the difference of the two closest points
        Vector3d dP = w + (sc * u) - (tc * v);  // =  S1(sc) - S2(tc)

        {
            var Separation = -dP;
            var Overlap = R1 + R2 - Separation.Length;
            //if(Overlap > 0)
            {
            Separation.Unitize();
            var Push = Separation * Overlap;

            Move[0] = (1 - sc) * -Push;
            Move[1] = (sc) * -Push;

            Move[2] = (1 - tc) * Push;
            Move[3] = (tc) * Push;

            Weighting[0] = Weighting[1] = Weighting[2] = Weighting[3] = Strength;
            }
            //else
            //{
            //  Move[0] = Move[1] = Move[2] = Move[3] = Vector3d.Zero;
            //  Weighting[0] = Weighting[1] = Weighting[2] = Weighting[3] = 0;
            //}
        }
        }
    }
}
# ---------- end lineline ----------
anchor = Anchor(Point=[end.Start, end.End], Strength=0.01)

list = ValueList({"Line Line": 0, "Line Line Custom": 1}, selected="Line Line")
filter = StreamFilter(Gate=list, Stream0=lineline.a)

goals = Data([length_line, anchor, relay, filter])
radius = ClusterOutput(number_slider)
goals_2 = ClusterOutput(goals)

# ==== cluster Pln
cg = ClusterInput()

draw = COMPASDraw(cg=cg)  # -> simplify(rg)
#   port cg: The COMPAS geometry or datastructure to be drawn.
#   port rg: The Rhino geometry object.
# ---------- draw: Python ----------
# r: compas>=2.8.1
"""
Draws COMPAS geometry in Grasshopper.
"""

from typing import Any

import Grasshopper

from compas.scene import SceneObject


class CompasToRhinoGeometry(Grasshopper.Kernel.GH_ScriptInstance):
    def RunScript(self, cg):
        if not cg:
            return None

        return SceneObject(item=cg).draw()
# ---------- end draw ----------
item = ListItem(List=draw, Index=0, Wrap=True)  # -> Item, Item1, Item2
pl = ConstructPlane(Origin=item.Item, XAxis=item.Item1, YAxis=item.Item2)  # -> flatten(Plane)

pl_2 = ClusterOutput(pl)

# ==== cluster L
L = ClusterInput()
item = ListItem(List=L, Index=0, Wrap=True)
debrep = DeconstructBrep(Brep=item)  # -> Faces, Edges, Vertices
item_2 = ListItem(List=debrep.Edges, Index=0, Wrap=True)
midpt = CurveMiddle(Curve=item_2)
M = ClusterOutput(midpt)

# ==== cluster _3DNumbering
data = ClusterInput()
E = ClusterInput()
X = UnitX(Factor="0.0022")
Z = UnitZ(Factor="0.0005")

srf = BoundarySurfaces(Edges=simplify(E))
scale = Scale(Geometry=srf, Center=Point(0, 0, 0), Factor="0.011")  # -> Geometry, Transform
Z_2 = UnitZ(Factor=Slider(-0.001, range=-0.01..0.01))

dam = DataDam(DataA=scale.Geometry, BufferDelay=10000000, BufferMode=0)

extr = Extrude(Base=dam, Direction=Z_2)  # -> simplify(Extrusion)

data_2 = Data(simplify(graft(data)))
data_3 = Data(simplify(extr))
orient = Orient(Geometry=data_3, Source=PlaneXY(0, 0, 0), Target=data_2)  # -> Geometry, Transform

data_4 = Data(simplify(scale.Geometry))
data_5 = Data(graft(data))
orient_2 = Orient(Geometry=data_4, Source=PlaneXY(0, 0, 0), Target=data_5)  # -> Geometry, Transform

move = Move(Geometry=orient.Geometry, Motion=X)  # -> Geometry, Transform
move_2 = Move(Geometry=orient_2.Geometry, Motion=X)  # -> Geometry, Transform
move_3 = Move(Geometry=move.Geometry, Motion=Z)  # -> Geometry, Transform
G = ClusterOutput(move_2.Geometry)
G_2 = ClusterOutput(move_3.Geometry)
