# Grasshopper definition room-class-example.ghx (Grasshopper 1.0.8)

script = Script()  # -> out, a
# ---------- script: Python ----------
from compas.geometry import Polygon
from compas.geometry import Point

class Room:
    def __init__(self, name: str, width: float, depth: float, point: Point = None):
        self.name = name
        self.width = width
        self.depth = depth
        self.point = point or Point(0, 0, 0)
        # self.geometry = Polygon.from_rectangle(Point(0, 0, 0), self.width, self.depth)

    @property
    def geometry(self) -> Polygon:
        return Polygon.from_rectangle(self.point, self.width, self.depth)

    def copy(self) -> "Room":
        new_room = Room(self.name, self.width, self.depth)
        return new_room

    def scale(self, factor: float):
        # self.width = self.width * factor
        self.width *= factor
        self.depth *= factor

    def __str__(self) -> str:
        # return "Room " + self.name
        # return "Room " + self.name + " (" + self.width
        # return "Room {} ({})".format(self.name, self.width)
        return f"Room {self.name} (Area={self.width * self.depth:.3f})"

if __name__ == "__main__":
    print("Hey coding architecture")
    room_a = Room("Living", 2700, 1800)
    room_b = room_a.copy()
    print(room_a)
    print(room_b)
    print("----")

    print(room_b.geometry)
    room_b.scale(1.5)
    print(room_b.geometry)
# ---------- end script ----------
