# Grasshopper definition e03_grammar_rules_exercise.ghx (Grasshopper 1.0.8)

# ----
# Exercise: grammar rules
boolean_toggle = BooleanToggle(True)
reload = Script(enabled=boolean_toggle)
# ---------- reload: Python ----------
from compas_rhino.devtools import DevTools
if enabled:
    DevTools.enable_reloader()
else:
    DevTools.disable_reloader()
# ---------- end reload ----------

rf_unit = Python3Script(
    sides=Slider(3, range=3..20),
    radius=Slider(0.1, range=0.1..3),
    start_eccentricity=Slider(0, range=-0.5..0.5),
    end_eccentricity=Slider(0, range=-0.5..0.5))  # -> rfunit, segment_lines, shape_edges; inputs sides: Int32
# ---------- rf_unit: Python ----------
# r: compas>=2.9, compas_timber>=0.14
# venv: ca-fs25

from compas_rhino import DevTools
DevTools.ensure_path()

from compas.geometry import Polygon

# 1. Import from the exercise file
# 2. Create polygon
# 3 Create the RFUnit instance
# 4. Call generate_segments
# 5. Output geometry to be visualized
# ---------- end rf_unit ----------
rf_unit_2 = Python3Script(
    sides=Slider(6, range=3..20),
    radius=Slider(0.1, range=0.1..3),
    start_eccentricity=Slider(0, range=-0.5..0.5),
    end_eccentricity=Slider(0, range=-0.5..0.5))  # -> rfunit, segment_lines, shape_edges; inputs sides: Int32; same code as rf_unit
compas_draw = COMPASDraw(cg=rf_unit.segment_lines)  # -> rg
#   port cg: The COMPAS geometry or datastructure to be drawn.
#   port rg: The Rhino geometry object.
# ---------- compas_draw: Python ----------
# r: compas>=2.8.1
"""
Draws COMPAS geometry in Grasshopper.
"""

from typing import Any

import Grasshopper

from compas.scene import SceneObject


class CompasToRhinoGeometry(Grasshopper.Kernel.GH_ScriptInstance):
    def RunScript(self, cg):
        if not cg:
            return None

        return SceneObject(item=cg).draw()
# ---------- end compas_draw ----------
compas_draw_2 = COMPASDraw(cg=rf_unit.shape_edges)  # -> rg; same code as compas_draw
compas_draw_3 = COMPASDraw(cg=rf_unit_2.segment_lines)  # -> rg; same code as compas_draw
compas_draw_4 = COMPASDraw(cg=rf_unit_2.shape_edges)  # -> rg; same code as compas_draw

script = Script(
    unit1=rf_unit.rfunit,
    unit2=rf_unit_2.rfunit,
    edge1=Slider(0, range=0..6),
    edge2=Slider(0, range=0..6),
    mirror=Toggle(False))  # -> out, geo; inputs edge1: Int32, edge2: Int32
# ---------- script: Python ----------
# r: compas>=2.9, compas_timber>=0.14
# venv: ca-fs25

from compas_rhino import DevTools
DevTools.ensure_path()

# ...
# ---------- end script ----------
compas_draw_5 = COMPASDraw(cg=script.geo)  # -> rg; same code as compas_draw
