# Grasshopper definition code_reloading.ghx (Grasshopper 1.0.8)
# Copyright: ETH Zürich

# ----
# Code Reloader
boolean_toggle = BooleanToggle(True)
reload = Script(enabled=boolean_toggle)  # -> reloader
# ---------- reload: Python ----------
from compas_rhino.devtools import DevTools
if enabled:
    DevTools.enable_reloader()
else:
    DevTools.disable_reloader()
# ---------- end reload ----------

# ---- group: House Object
# External Class
panel = Panel("MyHouse1")
create_house = Script(name=panel, area=Slider(75, range=0..100))  # -> house, geometry; inputs name: String, area: Double
# ---------- create_house: Python ----------
# r: compas>=2.9, compas_timber
# venv: ca-fs25

from compas_rhino import DevTools
DevTools.ensure_path()

from example_module import House

# ------------------------------------
# Execution
# ------------------------------------

# Create an instance of the House class
house = House(name, area)

# Generate the rectangle
house.generate_rectangle()
geometry = house.rectangle

# Print the house details
print(house)
# ---------- end create_house ----------

# ----
panel_2 = Panel(create_house.house)
draw = COMPASDraw(cg=create_house.geometry)  # -> rg
#   port cg: The COMPAS geometry or datastructure to be drawn.
#   port rg: The Rhino geometry object.
# ---------- draw: Python ----------
# r: compas>=2.8.1
"""
Draws COMPAS geometry in Grasshopper.
"""

from typing import Any

import Grasshopper

from compas.scene import SceneObject


class CompasToRhinoGeometry(Grasshopper.Kernel.GH_ScriptInstance):
    def RunScript(self, cg):
        if not cg:
            return None

        return SceneObject(item=cg).draw()
# ---------- end draw ----------
panel_3 = Panel(draw)
