# Grasshopper definition a01_a02_solution.ghx (Grasshopper 1.0.8)

rf_unit = Python3Script(
    sides=Slider(3, range=3..20),
    edge_length=Slider(0.184, range=0.1..3),
    start_eccentricity=Slider(0.096, range=-0.5..0.5),
    end_eccentricity=Slider(0, range=-0.5..0.5),
    overlap=Slider(0, range=0..0.5))  # -> rfunit, segment_lines, shape_edges; inputs sides: Int32
# ---------- rf_unit: Python ----------
# r: compas>=2.9, compas_timber>=0.14
# venv: ca-fs25

from compas_rhino import DevTools
DevTools.ensure_path()

import math

from compas.geometry import Polygon
from a01_a02_solution import RFUnit

radius = edge_length / (2 * math.sin(math.pi / sides))
shape = Polygon.from_sides_and_radius_xy(sides, radius)

# 8.2 Create the RFUnit instance
rfunit = RFUnit(shape, start_eccentricity, end_eccentricity, overlap)
rfunit.generate_segments()
rfunit.adjust_segments()

# 8.3 Output the edges and segment lines. You can visualize with the COMPAS Draw component right after
shape_edges = rfunit.edges
segment_lines = [segment.line for segment in rfunit.segments]
# ---------- end rf_unit ----------
rf_unit_2 = Python3Script(
    sides=Slider(3, range=3..20),
    edge_length=Slider(0.184, range=0.1..3),
    start_eccentricity=Slider(0.086, range=-0.5..0.5),
    end_eccentricity=Slider(0, range=-0.5..0.5),
    overlap=Slider(0, range=0..0.5))  # -> rfunit, segment_lines, shape_edges; inputs sides: Int32; same code as rf_unit
rf_unit_3 = Python3Script(
    sides=Slider(4, range=3..20),
    edge_length=Slider(0.184, range=0.1..3),
    start_eccentricity=Slider(0.2, range=-0.5..0.5),
    end_eccentricity=Slider(0, range=-0.5..0.5),
    overlap=Slider(0.026, range=0..0.5))  # -> rfunit, segment_lines, shape_edges; inputs sides: Int32; same code as rf_unit
compas_draw = COMPASDraw(cg=rf_unit.segment_lines)  # -> rg
#   port cg: The COMPAS geometry or datastructure to be drawn.
#   port rg: The Rhino geometry object.
# ---------- compas_draw: Python ----------
# r: compas>=2.8.1
"""
Draws COMPAS geometry in Grasshopper.
"""

from typing import Any

import Grasshopper

from compas.scene import SceneObject


class CompasToRhinoGeometry(Grasshopper.Kernel.GH_ScriptInstance):
    def RunScript(self, cg):
        if not cg:
            return None

        return SceneObject(item=cg).draw()
# ---------- end compas_draw ----------
compas_draw_2 = COMPASDraw(cg=rf_unit.shape_edges)  # -> rg; same code as compas_draw
compas_draw_3 = COMPASDraw(cg=rf_unit_2.segment_lines)  # -> rg; same code as compas_draw
compas_draw_4 = COMPASDraw(cg=rf_unit_2.shape_edges)  # -> rg; same code as compas_draw
compas_draw_5 = COMPASDraw(cg=rf_unit_3.segment_lines)  # -> rg; same code as compas_draw
compas_draw_6 = COMPASDraw(cg=rf_unit_3.shape_edges)  # -> rg; same code as compas_draw

# ----
# RF Structures
# A01 and A02: RF units, grammar rules and tessellations
boolean_toggle = BooleanToggle(True)
reload = Script(enabled=boolean_toggle)
# ---------- reload: Python ----------
# r: compas>=2.9, compas_timber>=0.14
# venv: ca-fs25

from compas_rhino.devtools import DevTools
if enabled:
    DevTools.enable_reloader()
else:
    DevTools.disable_reloader()
# ---------- end reload ----------

rule = Script(
    unit1=rf_unit.rfunit,
    unit2=rf_unit_2.rfunit,
    edge1=Slider(0, range=0..6),
    edge2=Slider(0, range=0..6),
    mirror=Toggle(True))  # -> rule, geo; inputs edge1: Int32, edge2: Int32
# ---------- rule: Python ----------
# r: compas>=2.9, compas_timber>=0.14
# venv: ca-fs25

from compas_rhino import DevTools
DevTools.ensure_path()

from a01_a02_solution import RFGrammarRule


rule = RFGrammarRule(unit1, unit2, edge1, edge2, mirror)
new_unit = rule.apply_rule(edge1, edge2, mirror)

geo = []
shape_edges = unit1.edges + new_unit.edges
segment_lines = [segment.line for segment in unit1.segments]
segment_lines += [segment.line for segment in new_unit.segments]
geo = shape_edges + segment_lines
# ---------- end rule ----------
rule_2 = Script(
    unit1=rf_unit_2.rfunit,
    unit2=rf_unit_3.rfunit,
    edge1=Slider(1, range=0..6),
    edge2=Slider(0, range=0..6),
    mirror=Toggle(True))  # -> rule, geo; inputs edge1: Int32, edge2: Int32; same code as rule
compas_draw_7 = COMPASDraw(cg=rule.geo)  # -> rg; same code as compas_draw
compas_draw_8 = COMPASDraw(cg=rule_2.geo)  # -> rg; same code as compas_draw

# ---- group: TESSELLATION
value_list = ValueList({"(3, 3, 3, 3, 3, 3)", "(4, 4, 4, 4)", "(3, 6, 3, 6)", "(6, 6, 6)", "(3, 3, 4, 3, 4)", "(4, 8, 8)", "(3, 3, 3, 3, 6)"}, selected="(3, 3, 4, 3, 4)")
tessellation_cycle = Script(rules=[rule.rule, rule_2.rule], vertex_config=value_list)  # -> tessellation, geo, graph; inputs rules: list
# ---------- tessellation_cycle: Python ----------
# r: compas>=2.9, compas_timber>=0.14
# venv: ca-fs25

from compas_rhino import DevTools
DevTools.ensure_path()

import random
from compas_rhino.conversions import line_to_rhino_curve, point_to_rhino
from a01_a02_solution import RFTessellation

import Rhino.Geometry as rg

vertex_config = eval(vertex_config)

tessellation = RFTessellation(vertex_configuration=vertex_config)
tessellation.apply_rules_cycle(rules)

# For each unit in the tessellation, assign the xyz values of the node attribute to the unit's centroid
graph = tessellation.graph
geo = []
edges = []
segments = []

for unit in tessellation.units:
    dot = rg.TextDot(f"Unit={unit.key}", point_to_rhino(unit.centroid))
    geo.append(dot)

    tessellation.graph.node_attributes(unit.key, "xyz", list(unit.centroid))

    for e, cp in enumerate(unit.connection_points):
        dot = rg.TextDot(f"E={unit.key}/{e}", point_to_rhino(cp.point - cp.vector/100.))
        geo.append(dot)

    edges.extend(unit.edges)
    segments.extend(unit.segments)

geo.extend(map(line_to_rhino_curve, edges))
geo.extend([line_to_rhino_curve(segment.line)  for segment in segments])
# ---------- end tessellation_cycle ----------
compas_draw_9 = COMPASDraw(cg=tessellation_cycle.graph)  # -> rg; same code as compas_draw
